# Grasshopper definition GHMockUp.gh (Grasshopper 0.9.76)

geo = Geometry(<brep referenced from the Rhino model>)
geo_2 = Geometry(<brep referenced from the Rhino model>)
domain = Domain()
geo_3 = Geometry(<brep referenced from the Rhino model>)
crv = Curve(<curve referenced from the Rhino model>)
crv_2 = Curve(<curve referenced from the Rhino model>)
geo_4 = Geometry(<brep referenced from the Rhino model>)
crv_3 = Curve(<curve referenced from the Rhino model>)
geo_5 = Geometry(<brep referenced from the Rhino model>)
geo_6 = Geometry([<brep referenced from the Rhino model> x2])
geo_7 = Geometry(<brep referenced from the Rhino model>)
geo_8 = Geometry([<brep referenced from the Rhino model> x2])
geo_9 = Geometry(<brep referenced from the Rhino model>)
crv_4 = Curve(<curve referenced from the Rhino model>)
geo_10 = Geometry([<brep referenced from the Rhino model> x5])
line = Line(crv_3)
line_2 = Line(crv)
line_3 = Line(crv_4)
fixed = VBScript(X=geo_8)  # -> Out, Constraint
ground = VBScript(X=geo_7)  # -> Out, Constraint
fixed_2 = VBScript(X=geo_6)  # -> Out, Constraint
line_4 = Line(crv_2)
id = Guid(geo_10)
volume = Volume(Geometry=geo_10)  # -> Volume, Centroid
line_on_line_lim = VBScript(X=geo_2, Y=line_2, Z=geo, U=line_4)  # -> Out, Constraint
hinge_no_lim = VBScript(X=geo_5, Y=geo_9, Z=line_3)  # -> Out, Constraint
mesh = MeshBrep(
    Brep=geo_10,
    Settings={GridMaxCount=0, GridMinCount=16, JaggedSeams=False, MaxEdgeLength=0, MinEdgeLength=0.0001, MinTolerance=0, Refine=True, RefineAngle=0, RelativeTolerance=0.65, SimplePlanes=True, Tolerance=0})
hinge_lim = VBScript(X=geo_3, Y=geo_4, Z=line, U=domain)  # -> Out, Constraint
xy = XYPlane(Origin=volume.Centroid)
pln = Plane(xy)
vb = VBScript(Guid=id, Mesh=mesh, BasePlane=pln)  # -> Out, RB
matrix = TransformMatrix(Digits=3)
