# Grasshopper definition KangarooMockup.gh (Grasshopper 1.0.7)
# plug-ins: Kangaroo2 Components

panel = Panel("AxisBase1")  # disabled
panel_2 = Panel("AxisTop1")  # disabled
panel_3 = Panel("Bracket")  # disabled
panel_4 = Panel("Target Path")
panel_5 = Panel("Bracket")
panel_7 = Panel("Revolute 2")
panel_9 = Panel("End Effector")
panel_12 = Panel("Revolute 1")
panel_14 = Panel("Revolute 3")
panel_16 = Panel("Revolute 4")
panel_18 = Panel("Revolute 5")
panel_19 = Panel("Revolute 6")
geo = Geometry(<brep referenced from the Rhino model>)  # disabled
geo_2 = Geometry(<brep referenced from the Rhino model>)  # disabled
geo_3 = Geometry(<brep referenced from the Rhino model>)  # disabled
panel_20 = Panel("3DOF ARM Mockup")
axis_curve = Curve(<curve referenced from the Rhino model>)
axis_curve_2 = Curve(<curve referenced from the Rhino model>)
revolutetop = Geometry(<brep referenced from the Rhino model>)
axis_curve_3 = Curve(<curve referenced from the Rhino model>)
revolutebase = Geometry(<brep referenced from the Rhino model>)
revolutetop_2 = Geometry(<brep referenced from the Rhino model>)
axis_curve_4 = Curve(<curve referenced from the Rhino model>)
revolutetop_3 = Geometry(<brep referenced from the Rhino model>)
axis_curve_5 = Curve(<curve referenced from the Rhino model>)
revolutebase_2 = Geometry(<brep referenced from the Rhino model>)
geo_4 = Geometry(<brep referenced from the Rhino model>)
axis_curve_6 = Curve(<curve referenced from the Rhino model>)
revolutebase_3 = Geometry(<brep referenced from the Rhino model>)
axis_curve_7 = Curve(<curve referenced from the Rhino model>)
revolutetop_4 = Geometry(<brep referenced from the Rhino model>)
axis_curve_8 = Curve(<curve referenced from the Rhino model>)
geo_5 = Geometry(<brep referenced from the Rhino model>)
geo_6 = Geometry(<brep referenced from the Rhino model>)
revolutetop_5 = Geometry(<brep referenced from the Rhino model>)
revolutebase_4 = Geometry(<brep referenced from the Rhino model>)
cluster = Cluster(G=geo)  # disabled
geo_7 = Geometry(<brep referenced from the Rhino model>)
revolutetop_6 = Geometry(<brep referenced from the Rhino model>)
geo_8 = Geometry(<brep referenced from the Rhino model>)
revolutebase_5 = Geometry(<brep referenced from the Rhino model>)
revolutetop_7 = Geometry(<brep referenced from the Rhino model>)
revolutetop_8 = Geometry(<brep referenced from the Rhino model>)
revolutebase_6 = Geometry(<brep referenced from the Rhino model>)
pt = Point(<point referenced from the Rhino model>)
geo_9 = Geometry(<brep referenced from the Rhino model>)
revolutebase_7 = Geometry(<brep referenced from the Rhino model>)
axis_curve_9 = Curve(<curve referenced from the Rhino model>)
geo_10 = Geometry(<brep referenced from the Rhino model>)
revolutebase_8 = Geometry(<brep referenced from the Rhino model>)
pt_2 = Point(<point referenced from the Rhino model>)
rb_pts = Cluster(G=geo_2)  # disabled
revolutetop_9 = Geometry(<brep referenced from the Rhino model>)
number_slider = Slider(10, range=0..100)
crv = Curve(<curve referenced from the Rhino model>)
revolutebase_9 = Geometry(<brep referenced from the Rhino model>)
cluster_2 = Cluster(G=geo_3)  # disabled
crv_2 = Curve(<curve referenced from the Rhino model>)
number_slider_2 = Slider(1.5, range=0..10)  # disabled
cluster_3 = Cluster(G=geo_4)
cluster_4 = Cluster(G=geo_5)
cluster_5 = Cluster(G=geo_6)
cluster_6 = Cluster(G=geo_7)
cluster_7 = Cluster(G=geo_8)
cluster_8 = Cluster(G=geo_10)
cluster_9 = Cluster(G=geo_9)
xy = XYPlane(Origin=pt)
geo_11 = Geometry(geo_2)  # disabled
pt_3 = Point(rb_pts)  # disabled
geo_12 = Geometry(geo_3)  # disabled
geo_13 = Geometry(geo)  # disabled
pt_4 = Point(cluster_2)  # disabled
pt_5 = Point(cluster)  # disabled
revolute_set = RevoluteSet(revolutebase=revolutebase_5, axis_curve=axis_curve_5, revolutetop=revolutetop_5)  # -> pt_3, constraint_2, pt_4
revolute_set_2 = RevoluteSet(revolutebase=revolutebase_3, axis_curve=axis_curve_3, revolutetop=revolutetop_3)  # -> pt_3, constraint_2, pt_4
revolute_set_3 = RevoluteSet(revolutebase=revolutebase, axis_curve=axis_curve, revolutetop=revolutetop)  # -> pt_3, constraint_2, pt_4
revolute_set_4 = RevoluteSet(revolutebase=revolutebase_6, axis_curve=axis_curve_6, revolutetop=revolutetop_6)  # -> pt_3, constraint_2, pt_4
revolute_set_5 = RevoluteSet(revolutebase=revolutebase_7, axis_curve=axis_curve_7, revolutetop=revolutetop_8)  # -> pt_3, constraint_2, pt_4
revolute_set_6 = RevoluteSet(revolutebase=revolutebase_8, axis_curve=axis_curve_8, revolutetop=revolutetop_7)  # -> pt_3, constraint_2, pt_4
revolute_set_7 = RevoluteSet(revolutebase=revolutebase_4, axis_curve=axis_curve_4, revolutetop=revolutetop_4)  # -> pt_3, constraint_2, pt_4
revolute_set_8 = RevoluteSet(revolutebase=revolutebase_2, axis_curve=axis_curve_2, revolutetop=revolutetop_2)  # -> pt_3, constraint_2, pt_4
revolute_set_9 = RevoluteSet(revolutebase=revolutebase_9, axis_curve=axis_curve_9, revolutetop=revolutetop_9)  # -> pt_3, constraint_2, pt_4
number_slider_3 = Slider(0, range=0..100)  # disabled
geo_14 = Geometry(geo_4)
geo_15 = Geometry(geo_5)
frame = CurveFrame(Curve=reparameterize(crv), Parameter=Slider(0.144, range=0..0.2))
geo_16 = Geometry(geo_6)
pt_6 = Point(cluster_3)
geo_17 = Geometry(geo_7)
geo_18 = Geometry(geo_8)
pt_7 = Point(cluster_4)
pt_8 = Point(cluster_5)
pt_9 = Point(cluster_6)
pt_10 = Point(cluster_7)
pt_11 = Point(flatten([pt_2, cluster_9]))
plane_pt = PlanePt(F=number_slider, B=xy)
eval = EvaluateCurve(Curve=reparameterize(crv_2), Parameter=Slider(0.2, range=0..0.2))  # -> Point, Tangent, Angle
rigidbody = RigidBody(Part=geo_12, Points=pt_4, Strength=number_slider_2)  # -> RigidBody, Planes; disabled
rigidbody_2 = RigidBody(Part=geo_13, Points=pt_5, Strength=number_slider_2)  # -> RigidBody, Planes; disabled
rigidbody_3 = RigidBody(Part=geo_11, Points=pt_3, Strength=number_slider_2)  # -> RigidBody, Planes; disabled
rigidbody_4 = RigidBody(Part=geo_14, Points=pt_6, Strength=10)  # -> RigidBody, Planes
rigidbody_5 = RigidBody(Part=geo_15, Points=pt_7, Strength=10)  # -> RigidBody, Planes
rigidbody_6 = RigidBody(Part=geo_16, Points=pt_8, Strength=10)  # -> RigidBody, Planes
rigidbody_7 = RigidBody(Part=geo_17, Points=pt_9, Strength=10)  # -> RigidBody, Planes
rigidbody_8 = RigidBody(Part=geo_18, Points=pt_10, Strength=10)  # -> RigidBody, Planes
plane_pt_2 = PlanePt(F=number_slider, B=frame)
pt_12 = Point(flatten(plane_pt))
pt_13 = Point(flatten([cluster_8, pt_12]))
pt_14 = Point(revolute_set_3.pt_4)
pt_15 = Point(revolute_set_3.pt_3)
pt_16 = Point(revolute_set_8.pt_4)
pt_17 = Point(revolute_set_8.pt_3)
pt_18 = Point(revolute_set_2.pt_4)
pt_19 = Point(revolute_set_2.pt_3)
pt_20 = Point(revolute_set_7.pt_4)
pt_21 = Point(revolute_set_7.pt_3)
anchor = Anchor(Point=pt_2, Target=eval.Point, Strength=10000)
pt_22 = Point(revolute_set.pt_4)
rigidbody_9 = RigidBody(Part=geo_10, Points=pt_13, Strength=10)  # -> RigidBody, Planes
pt_23 = Point(revolute_set.pt_3)
rigidbody_10 = RigidBody(Part=geo_9, Points=pt_11, Strength=10)  # -> RigidBody, Planes
pt_24 = Point(revolute_set_4.pt_4)
pt_25 = Point(revolute_set_4.pt_3)
pt_26 = Point(revolute_set_5.pt_4)
pt_27 = Point(revolute_set_6.pt_4)
pt_28 = Point(revolute_set_5.pt_3)
pt_29 = Point(revolute_set_6.pt_3)
grab = Grab(On=True, Strength=1, Range=3)  # -> Grab, Anchors
axis_curve_10 = Curve(<curve referenced from the Rhino model>)  # disabled
pt_30 = Point(revolute_set_9.pt_3)
pt_31 = Point(revolute_set_9.pt_4)
anchor_2 = Anchor(Point=pt_3, Strength=10000)  # disabled
rigidpointset = RigidPointSet(Points=flatten([pt_11, pt_9]), Strength=10)  # -> RigidBody, Planes
grab_2 = Grab(On=True, Strength=1, Range=3)  # -> Grab, Anchors
rigidpointset_2 = RigidPointSet(Points=flatten([pt_14, pt_8]), Strength=10)  # -> RigidBody, Planes
grab_3 = Grab(On=True, Strength=1, Range=3)  # -> Grab, Anchors
rigidpointset_3 = RigidPointSet(Points=flatten([pt_18, pt_15]), Strength=10)  # -> RigidBody, Planes
rigidpointset_4 = RigidPointSet(Points=flatten([pt_22, pt_7]), Strength=10)  # -> RigidBody, Planes
rigidpointset_5 = RigidPointSet(Points=flatten([pt_16, pt_10]), Strength=10)  # -> RigidBody, Planes
rigidpointset_6 = RigidPointSet(Points=flatten([pt_8, pt_23]), Strength=10)  # -> RigidBody, Planes
rigidpointset_7 = RigidPointSet(Points=flatten([pt_20, pt_17]), Strength=10)  # -> RigidBody, Planes
rigidpointset_8 = RigidPointSet(Points=flatten([pt_27, pt_9]), Strength=10)  # -> RigidBody, Planes
rigidpointset_9 = RigidPointSet(Points=flatten([pt_10, pt_29]), Strength=10)  # -> RigidBody, Planes
rigidpointset_10 = RigidPointSet(Points=flatten([pt_25, pt_7]), Strength=10)  # -> RigidBody, Planes
rigidpointset_11 = RigidPointSet(Points=flatten([pt_24, pt_28]), Strength=10)  # -> RigidBody, Planes
rigidpointset_12 = RigidPointSet(Points=flatten([pt_26, pt_6]), Strength=10)  # -> RigidBody, Planes
rigidpointset_13 = RigidPointSet(Points=[pt_5, pt_4], Strength=10)  # -> RigidBody, Planes; disabled
anchor_3 = Anchor(Point=pt_19, Strength=10000)
anchor_4 = Anchor(Point=pt_21, Strength=10000)
rigidpointset_14 = RigidPointSet(Points=flatten([pt_6, pt_30]), Strength=10)  # -> RigidBody, Planes
revoluteaxis = RevoluteAxis(pt=pt_3, C=axis_curve_10, pt_2=pt_5, strength=10)  # disabled
data = Data(revolute_set_3.constraint_2)
anchor_5 = Anchor(Point=graft(pt_12), Target=graft(plane_pt_2), Strength=Slider(1000, range=0..1000))  # -> flatten(A)
data_2 = Data(revolute_set_8.constraint_2)
data_3 = Data(revolute_set_2.constraint_2)
rigidpointset_15 = RigidPointSet(Points=flatten([pt_31, pt_13]), Strength=10)  # -> RigidBody, Planes
data_4 = Data(revolute_set_7.constraint_2)
number_slider_4 = Slider(10, range=0..100)  # disabled
button = Button()  # disabled
button_2 = Button()  # disabled
revolutetop_10 = Geometry(<brep referenced from the Rhino model>)
revolutebase_10 = Geometry(<brep referenced from the Rhino model>)
solver = Solver(
    GoalObjects=flatten([anchor_3, rigidbody_6.RigidBody, rigidpointset_2.RigidBody, data_3, rigidpointset_3.RigidBody, data, rigidpointset_6.RigidBody, rigidpointset_4.RigidBody, revolute_set.constraint_2, rigidbody_5.RigidBody, grab_2.Grab, rigidpointset_10.RigidBody, rigidbody_9.RigidBody, anchor_5, revolute_set_4.constraint_2, rigidpointset_11.RigidBody, revolute_set_5.constraint_2, rigidpointset_12.RigidBody, rigidbody_4.RigidBody, rigidpointset_14.RigidBody, revolute_set_9.constraint_2, rigidpointset_15.RigidBody]),
    Reset=Button(),
    Threshold=1e-15,
    Tolerance=0.01,
    On=True)  # -> I, V, O; disabled
toggle = BooleanToggle(True)  # disabled
multiplication = Multiplication(A=button, B=number_slider_4)  # disabled
colour = ColourPicker(PickedColour=RGBA(140, 160, 189, 197))  # disabled
solver_2 = Solver(
    GoalObjects=[anchor_2, rigidbody_3.RigidBody, revoluteaxis, rigidbody_2.RigidBody, rigidbody.RigidBody, rigidpointset_13.RigidBody],
    Reset=button_2,
    Threshold=1e-15,
    Tolerance=0.01,
    On=True)  # -> I, V, O; disabled
geo_19 = Geometry([revolutebase_10, revolutetop_10])
stepsolver = StepSolver(
    GoalObjects=flatten([anchor_4, rigidbody_8.RigidBody, rigidpointset_5.RigidBody, data_4, rigidpointset_7.RigidBody, data_2, rigidpointset_9.RigidBody, rigidpointset_8.RigidBody, revolute_set_6.constraint_2, rigidbody_7.RigidBody, grab_3.Grab, rigidpointset.RigidBody, rigidbody_10.RigidBody, anchor]),
    Tolerance=0.01,
    Momentum=False,
    Damping=0.99,
    SubIterations=multiplication,
    Animate=toggle)  # -> I, V, O; disabled
# Steps to Converge: Not Converge after 3M
panel_22 = Panel(solver.I)
volume = Volume(Geometry=geo_19)  # -> Volume, Centroid
xy_2 = XYPlane(Origin=volume.Centroid)
panel_23 = Panel(stepsolver.I)  # disabled
steps_to_converge = Panel("322020")  # disabled
preview = CustomPreview(Geometry=stepsolver.O, Material=colour)  # disabled
prot = RotatePlane(Plane=xy_2, Angle=degrees(Slider(30, range=0..100)))
crv_3 = Curve(<curve referenced from the Rhino model>)
number_slider_5 = Slider(1, range=0..1)
rigid_body = VBScript(mesh=geo_19, id=geo_19, plane=prot)  # -> out, rb; inputs mesh: Mesh, id: Guid, plane: Plane
# ---------- rigid_body: VB usings ----------
Public Class RigidBody
  Public const code = "rb"
  Public guid As GUID
  Public mesh As Mesh
  Public plane As Plane

  Public Sub New(ByRef _mesh As Mesh, ByRef _plane As Plane)
    mesh = _mesh
    plane = _plane
  End Sub

  Public Function Quaternion() As Quaternion
    Return Quaternion.Rotation(Rhino.Geometry.Plane.WorldXY, plane)
  End Function

  ''' <summary>
  ''' Returns the state of the rigid body in an array. XYZABCD
  ''' </summary>
  ''' <returns></returns>
  Public Function GetStateArray() As Double()
    Dim q As Quaternion = Quaternion()
    Dim p As Point3D = plane.origin
    Dim stateArray As Double() = New Double() {p.X, p.Y, p.Z, q.A, q.B, q.C, q.D}
    Return stateArray
  End Function



End Class
# ---------- rigid_body: VB ----------
    '    If plane Is Nothing Then
    '      plane = Rhino.Geometry.Plane.WorldXY
    '    End If
    rb = New RigidBody(mesh, plane)
    rb.guid = id

    Print(rb.guid.ToString())

    Dim stateArray As Double() = rb.GetStateArray()
    Print(String.Join(",", stateArray))
# ---------- end rigid_body ----------
item = ListItem(List=prot, Index=0, Wrap=True)  # -> Item, Item1
item_2 = ListItem(List=rigid_body.rb, Index=0, Wrap=True)  # -> Item, Item1

# ---- group: Overides the fileName variable
panel_24 = Panel(panel_23)  # disabled

# ---- group: Make a screen capture to file
swatch = ColourSwatch(SwatchColor=RGB(255, 255, 255))  # disabled
number_slider_6 = Slider(1920, range=0..10000)  # disabled
number_slider_7 = Slider(1080, range=0..10000)  # disabled
openfile = BooleanToggle(False)  # disabled
toggle_2 = BooleanToggle(False)  # disabled
toggle_3 = BooleanToggle(False)  # disabled
toggle_4 = BooleanToggle(False)  # disabled
vcf = ViewportCaptureToFile(
    Toggle=button,
    Width=number_slider_6,
    Height=number_slider_7,
    BackgroundColor=swatch,
    Grid=toggle_2,
    WorldAxes=toggle_3,
    CPlaneAxes=toggle_4,
    OpenFile=openfile,
    FileName=panel_24)  # -> Path; inputs BackgroundColor: Color; disabled
# ---------- vcf: Python ----------
"""
Captures the Rhino viewport to an image file. Places the image in a folder called
Captures in the same directory as the GH definition. Names the image the same as 
the GH defintion followed by _hourMinuteSecond. Edit the script directly to set more options.
Note: Do not use this script with the GH button, freezes up the canvas for some reason.

    Inputs:
        Toggle: Activate the component using a boolean toggle. Do NOT use a Button {item,bool}
        BackgroundColor: Set the color of the Rhino viewport background {item,color,optional}
        Grid: Turn on the grid {item,bool,optional}
        WorldAxes:Turn on the world axes {item,bool,optional}
        CPlaneAxes: Turn on the cplane axes {item,bool,optional}
        OpenFile: If true the image will open in the default application {item,bool,optional}
    Outputs:
        Path: The path of the captured image {item,str}
    Remarks:
        Author: Anders Holden Deleuran
        License: Apache License 2.0
        Version: 160805
"""
ghenv.Component.Name = "ViewportCaptureToFile"
ghenv.Component.NickName ="VCF"
ghenv.Component.Category = "CM_FAHS"
ghenv.Component.SubCategory = "1 Automation"

import os
import datetime
import System
import scriptcontext as sc
import Rhino as rc

def checkOrMakeFolder():
    
    """ Check/makes a "Captures" folder in the GH def folder """
    
    if ghdoc.Path:
        folder = os.path.dirname(ghdoc.Path)
        captureFolder = folder + "\\Captures"
        if not os.path.isdir(captureFolder):
            os.makedirs(captureFolder)
        return captureFolder

def makeFileName():
    
    """ Make a string with the gh def name + current hourMinuteSecond """
    
    # Make hour minute seconds string
    n = datetime.datetime.now()
    ho,mt,sc = str(n.hour),str(n.minute),str(n.second)
    if len(ho) == 1:
        ho = "0"+ ho
    if len(mt) == 1:
        mt = "0"+mt
    if len(sc) == 1:
        sc = "0"+ sc
    hms = ho+mt+sc
    
    # Get name of GH def
    ghDef = ghenv.LocalScope.ghdoc.Name.strip("*")
    
    # Concatenate and return
    fileName = ghDef + "_" + hms
    
    return fileName

def captureActiveViewToFile(width,height,path,grid,worldAxes,cplaneAxes):
    
    """
    Captures the active view to an image file at the path. Path looks like this:
    "C:\\Users\\adel\\Desktop\\Captures\\foooo_112747.png"
    """
    
    # Set the script context to the current Rhino doc
    sc.doc = rc.RhinoDoc.ActiveDoc
    
    # Get the active view and set image dimensions
    activeView = sc.doc.Views.ActiveView
    imageDim = System.Drawing.Size(width,height)
    
    # Perform the capture
    try:
        imageCap = rc.Display.RhinoView.CaptureToBitmap(activeView,imageDim,grid,worldAxes,cplaneAxes)
        System.Drawing.Bitmap.Save(imageCap,path)
        rc.RhinoApp.WriteLine(path)
        return path
    except:
        raise Exception(" Capture failed, check the path")

# Set background color
if BackgroundColor:
    rc.ApplicationSettings.AppearanceSettings.ViewportBackgroundColor = BackgroundColor

# Capture
if Toggle:
    if not Width:
        Width = 1920
    if not Height:
        Height = 1080
    capFolder = checkOrMakeFolder()
    if FileName:
        fileName = FileName
    else:
        fileName = makeFileName()
    try:
        path = os.path.join(capFolder,fileName + ".jpg")
        Path = captureActiveViewToFile(Width,Height,path,Grid,WorldAxes,CPlaneAxes)
        if OpenFile:
            os.startfile(path)
    except:
        raise Exception(" Capture failed, save the GH definition")
# ---------- end vcf ----------
panel_25 = Panel(vcf)  # disabled

# ----
pt_32 = Point(<point referenced from the Rhino model>)
pt_33 = Point(<point referenced from the Rhino model>)
fixed = VBScript(Rb0=item_2.Item, Rb1=item_2.Item1)  # -> Out, Constraint
end_effector_point = VBScript(rb=item_2.Item1, endEffectorTip=pt_32, target=pt_33)  # -> out, constraint; inputs endEffectorTip: Point3d, target: Point3d
# ---------- end_effector_point: VB usings ----------
Class EndEffectorConstraintPt
  Public Const code = "endPt"
  Public rb0 As Object
  Public rb0pt0 As Point3d
  Public tgtpt0 As Point3d

  Public Sub New(ByRef _rb0)
    rb0 = _rb0
  End Sub

End Class
# ---------- end_effector_point: VB ----------
    Dim t_rb0 As Transform = Rhino.Geometry.Transform.ChangeBasis(Rhino.Geometry.Plane.WorldXY, rb.plane)
    Dim rb0pt0 As Point3d = New Point3d(endEffectorTip)

    Dim c As New EndEffectorConstraintPt(rb)
    c.rb0pt0 = rb0pt0
    c.tgtpt0 = New Point3d(target)
    
    constraint = c
# ---------- end end_effector_point ----------
hinge = VBScript(rb0=item_2.Item, rb1=item_2.Item1, axis=crv_3)  # -> out, constraint; inputs axis: Line
# ---------- hinge: VB usings ----------
Class HingeConstraint
  Public Const code = "hin"
  Public rb0 As Object
  Public rb1 As Object
  Public rb0pt0 As Point3d
  Public rb0pt1 As Point3d
  Public rb1pt0 As Point3d
  Public rb1pt1 As Point3d

  Public Sub New(ByRef _rb0, ByRef _rb1)
    rb0 = _rb0
    rb1 = _rb1
  End Sub

End Class
# ---------- hinge: VB ----------
    Dim t_rb0 As Transform = Rhino.Geometry.Transform.ChangeBasis(Rhino.Geometry.Plane.WorldXY, rb0.plane)
    Dim t_rb1 As Transform = Rhino.Geometry.Transform.ChangeBasis(Rhino.Geometry.Plane.WorldXY, rb1.plane)
    Dim rb0pt0 As Point3d = New Point3d(axis.From())
    Dim rb0pt1 As Point3d = New Point3d(axis.To())
    Dim rb1pt0 As Point3d = New Point3d(axis.From())
    Dim rb1pt1 As Point3d = New Point3d(axis.To())
    rb0pt0.Transform(t_rb0)
    rb0pt1.Transform(t_rb0)
    rb1pt0.Transform(t_rb1)
    rb1pt1.Transform(t_rb1)

    Dim c As New HingeConstraint(rb0, rb1)
    c.rb0pt0 = rb0pt0
    c.rb0pt1 = rb0pt1
    c.rb1pt0 = rb1pt0
    c.rb1pt1 = rb1pt1

    constraint = c
# ---------- end hinge ----------
ground = VBScript(rb=item_2.Item)  # -> out, A
# ---------- ground: VB usings ----------
Class GroundConstraint
  Public Const code = "gnd"
  Public rb0 As Object
  
  Public Sub New(ByRef rb)
    rb0 = rb
  End Sub
  
End Class
# ---------- ground: VB ----------
    A = New GroundConstraint(rb)
    print(A.rb0.guid.ToString())

    Dim ptO As Point3d = A.rb0.plane.Origin()

    Dim vecX As Vector3d = A.rb0.plane.XAxis()
    vecX.Unitize()
    Dim ptX As Point3d = ptO + vecX
    Dim vecY As Vector3d = A.rb0.plane.YAxis()
    vecY.Unitize()
    Dim ptY As Point3d = ptO + vecY

    print(ptO.ToString())
    print(ptX.ToString())
    print(ptY.ToString())
# ---------- end ground ----------
pt_34 = PointOriented(BasePlane=item.Item, UComponent=Slider(1, range=0..1), VComponent=0, WComponent=0)
ik = VBScript(rbs=rigid_body.rb, constraints=[ground.A, hinge.constraint, end_effector_point.constraint])  # -> out, A; inputs rbs: list, constraints: list
# ---------- ik: VB ----------
    Dim rbDict As New Dictionary(Of String, Integer)

    print("RigidBodyCount = " + rbs.count().ToString())
    Dim index As Integer = 0
    For Each rb As Object In rbs
      Dim code As String = rb.code() + ","
      Dim stateArray As Double() = rb.GetStateArray()
      code += String.Join(",", stateArray)
      print(code)
      'Add Rigid Body to Dictionary
      rbDict.Add(rb.guid.ToString(), index)
      index += 1
    Next

    For Each c As Object In constraints
      Dim code As String = c.code()
      Dim codeLine As String


      If code = "gnd" Then
        'Ground Constraint Output
        codeLine = code + "," + rbDict.Item(c.rb0.guid.ToString()).ToString()
      Else If  code = "hin" Then
        'Hinge Constraint Output
        codeLine = code + "," + FindRBID(c.rb0, rbDict) + "," + FindRBID(c.rb1, rbDict)
        codeLine += "," + PointToString(c.rb0pt0)
        codeLine += "," + PointToString(c.rb0pt1)
        codeLine += "," + PointToString(c.rb1pt0)
        codeLine += "," + PointToString(c.rb1pt1)
      Else If  code = "endPt" Then
        codeLine = code + "," + FindRBID(c.rb0, rbDict)
        codeLine += "," + PointToString(c.rb0pt0)
        codeLine += "," + PointToString(c.tgtpt0)
      Else
        'Not a known constraint
        Continue For
      End If


      print(codeLine)
    Next
# ---------- ik: VB additional code ----------
  Function FindRBID(rb, rbDict) As String
    'Print(rb.guid.ToString())
    Return rbDict.Item(rb.guid.ToString()).ToString()
  End Function

  Function PointToString(pt As Point3d) As String
    Return pt.X.ToString + "," + pt.Y.ToString + "," + pt.Z.ToString
  End Function
# ---------- end ik ----------
panel_26 = Panel(pt_34)
panel_27 = Panel(rigid_body.out)
send_to_optimizer = Panel(ik.out)

# ==== cluster Cluster
G = ClusterInput()
bbox = BoundingBox(Content=G, Plane=PlaneXY(0, 0, 0))  # -> Box, Box_2
volume = Volume(Geometry=G)  # -> Volume, Centroid
debrep = DeconstructBrep(Brep=bbox.Box_2)  # -> Faces, Edges, Vertices
scale = Scale(Geometry=debrep.Vertices, Center=volume.Centroid, Factor=0.1887215)  # -> Geometry, Transform
G_2 = ClusterOutput(scale.Geometry)

# ==== cluster RevoluteAxis
pt = ClusterInput()
C = ClusterInput()
pt_2 = ClusterInput()
strength = ClusterInput()
pt_3 = Point(pt)
divide = DivideCurve(Curve=C, Count=2, Kinks=False)  # -> flatten(Points), Tangents, Parameters
pt_4 = Point(pt_2)
strength_2 = Number(strength)
rigidpointset = RigidPointSet(Points=flatten([pt_4, divide.Points]), Strength=strength_2)  # -> RigidBody, Planes
rigidpointset_2 = RigidPointSet(Points=flatten([pt_3, divide.Points]), Strength=strength_2)  # -> RigidBody, Planes
data = Data([rigidpointset.RigidBody, rigidpointset_2.RigidBody])
data_2 = ClusterOutput(data)

# ==== cluster RevoluteSet
revolutetop = ClusterInput()
revolutebase = ClusterInput()
revolutetop_2 = Geometry(revolutetop)
revolutebase_2 = Geometry(revolutebase)
rb_pts = RBPts(G=revolutetop_2)
rb_pts_2 = RBPts(G=revolutebase_2)
pt = Point(flatten(rb_pts))
pt_2 = Point(flatten(rb_pts_2))
geo = Geometry(revolutebase_2)
geo_2 = Geometry(revolutetop_2)
rigidbody = RigidBody(Part=geo_2, Points=pt, Strength=10)  # -> RigidBody, Planes
rigidbody_2 = RigidBody(Part=geo, Points=pt_2, Strength=10)  # -> RigidBody, Planes
pt_3 = ClusterOutput(pt_2)
pt_4 = ClusterOutput(pt)
axis_curve = ClusterInput()
revoluteaxis = RevoluteAxis(pt=pt_2, C=axis_curve, pt_2=pt, strength=100)
constraint = Data(flatten([rigidbody_2.RigidBody, revoluteaxis, rigidbody.RigidBody]))
constraint_2 = ClusterOutput(constraint)

# ==== cluster PlanePt
F = ClusterInput()
addition = Addition(B=[Point(0, 0, 0), Point(1, 0, 0), Point(0, 1, 0), Point(0, 0, 1)])
B = ClusterInput()
scale = Scale(Geometry=addition, Center=Point(0, 0, 0), Factor=F)  # -> Geometry, Transform
orient = Orient(Geometry=scale.Geometry, Source=PlaneXY(0, 0, 0), Target=B)  # -> Geometry, Transform
G = ClusterOutput(orient.Geometry)

# ==== cluster RBPts
G = ClusterInput()
volume = Volume(Geometry=G)  # -> Volume, Centroid
bbox = BoundingBox(Content=G, Plane=PlaneXY(0, 0, 0))  # -> Box, Box_2
debrep = DeconstructBrep(Brep=bbox.Box_2)  # -> Faces, Edges, Vertices
scale = Scale(Geometry=debrep.Vertices, Center=volume.Centroid, Factor=0.1887215)  # -> Geometry, Transform
split = SplitList(List=scale.Geometry, Index=4)  # -> ListA, ListB; disabled
G_2 = ClusterOutput(scale.Geometry)
