# Grasshopper definition SimPackager.gh (Grasshopper 1.0.7)

geo = Geometry([<brep referenced from the Rhino model> x7])
geo_2 = Geometry(geo)
volume = Volume(Geometry=geo_2)  # -> Volume, Centroid
xy = XYPlane(Origin=volume.Centroid)
revolutetop = Geometry(<brep referenced from the Rhino model>)
revolutebase = Geometry(<brep referenced from the Rhino model>)
prot = RotatePlane(Plane=xy, Angle=degrees(Slider(0, range=0..100)))
geo_3 = Geometry([revolutebase, revolutetop])
rigid_body = VBScript(mesh=geo_2, id=geo_2, plane=prot)  # -> out, rb; inputs mesh: Mesh, id: Guid, plane: Plane
# ---------- rigid_body: VB usings ----------
Public Class RigidBody
  Public const code = "rb"
  Public guid As GUID
  Public mesh As Mesh
  Public plane As Plane

  Public Sub New(ByRef _mesh As Mesh, ByRef _plane As Plane)

    plane = _plane
    Dim t_rb0 As Transform = Rhino.Geometry.Transform.ChangeBasis(Rhino.Geometry.Plane.WorldXY, _plane)
    _mesh.Transform(t_rb0)
    mesh = _mesh
  End Sub

  Public Function Quaternion() As Quaternion
    Return Quaternion.Rotation(Rhino.Geometry.Plane.WorldXY, plane)
  End Function

  ''' <summary>
  ''' Returns the state of the rigid body in an array. XYZABCD
  ''' </summary>
  ''' <returns></returns>
  Public Function GetStateArray() As Double()
    Dim q As Quaternion = Quaternion()
    Dim p As Point3D = plane.origin
    Dim stateArray As Double() = New Double() {p.X, p.Y, p.Z, q.A, q.B, q.C, q.D}
    Return stateArray
  End Function



End Class
# ---------- rigid_body: VB ----------
    '    If plane Is Nothing Then
    '      plane = Rhino.Geometry.Plane.WorldXY
    '    End If
    rb = New RigidBody(mesh, plane)
    rb.guid = id

    Print(rb.guid.ToString())

    Dim stateArray As Double() = rb.GetStateArray()
    Print(String.Join(",", stateArray))
# ---------- end rigid_body ----------
volume_2 = Volume(Geometry=geo_3)  # -> Volume, Centroid
panel = Panel("C:\Users\Victor\Documents\GitHub\comp-fab-a2-yck011522\RhinoPython\log.txt")
xy_2 = XYPlane(Origin=volume_2.Centroid)
log = Panel("""-390.538,1670.91,48.1868,-0.0728547,-0.531503,-1.13067,-392.453,1616.14,117.288,-0.0381901,-0.5315,1.03732
-391.235,1671.07,47.2842,0.0936433,0.0135196,-3.92157,-344.869,1619.33,123.55,0.113633,0.0308211,1.28115
-389.417,1665.04,49.9192,0.0204388,-0.0222855,-4.62806,-342.677,1616,119.29,0.0217253,-0.0209827,1.31984
-389.608,1664.53,49.9756,0.0137334,-0.0144971,-5.52889,-342.396,1615.92,119.154,0.0139065,-0.0143206,1.31489
-389.787,1664.66,49.9927,0.0113482,-0.0113509,-5.75808,-342.368,1616.13,119.172,0.0113523,-0.011347,1.31384
-389.786,1664.67,49.9946,0.00947086,-0.00946003,-5.75936,-342.274,1616.23,119.175,0.00946983,-0.00946126,1.313
-389.786,1664.67,49.9955,0.00782742,-0.00782372,-5.7594,-342.193,1616.31,119.177,0.00782656,-0.00782474,1.3123
-389.786,1664.67,49.9963,0.00646894,-0.00646945,-5.75944,-342.127,1616.38,119.178,0.00646823,-0.00647028,1.31172
-389.786,1664.67,49.997,0.00534608,-0.00534893,-5.75946,-342.072,1616.43,119.18,0.0053455,-0.00534963,1.31125
-389.786,1664.67,49.9975,0.00441803,-0.00442205,-5.75949,-342.026,1616.48,119.18,0.00441755,-0.00442262,1.31086
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""")
item = ListItem(List=rigid_body.rb, Index=0, Wrap=True)  # -> Item, Item1, Item2, Item3, Item4, Item5, Item6
prot_2 = RotatePlane(Plane=xy_2, Angle=degrees(Slider(30, range=0..100)))
shift = ShiftList(List=rigid_body.rb, Shift=1, Wrap=False)
shift_2 = ShiftList(List=rigid_body.rb, Shift=-1, Wrap=False)
crv = Curve(<curve referenced from the Rhino model>)
crv_2 = Curve([<curve referenced from the Rhino model> x6])
target_pt = Point(<point referenced from the Rhino model>)
pt = Point(<point referenced from the Rhino model>)
pt_2 = Point(<point referenced from the Rhino model>)
pt_3 = Point(<point referenced from the Rhino model>)
rigid_body_2 = VBScript(mesh=geo_3, id=geo_3, plane=prot_2)  # -> out, rb; inputs mesh: Mesh, id: Guid, plane: Plane; same code as rigid_body
item_2 = ListItem(List=rigid_body_2.rb, Index=0, Wrap=True)  # -> Item, Item1
file = ReadFile(File=panel, PerLineParse=True)
file_2 = ReadFile(PerLineParse=True)
subtraction = Subtraction(A=target_pt, B=pt)
lng = ListLength(List=file)
steps = Panel(lng)
end_effector_point = VBScript(rb=item_2.Item1, endEffectorTip=pt_2, target=pt_3)  # -> out, constraint; inputs endEffectorTip: Point3d, target: Point3d
# ---------- end_effector_point: VB usings ----------
Class EndEffectorConstraintPt
  Public Const code = "endPt"
  Public rb0 As Object
  Public rb0pt0 As Point3d
  Public tgtpt0 As Point3d

  Public Sub New(ByRef _rb0)
    rb0 = _rb0
  End Sub

End Class
# ---------- end_effector_point: VB ----------
    Dim t_rb0 As Transform = Rhino.Geometry.Transform.ChangeBasis(Rhino.Geometry.Plane.WorldXY, rb.plane)
    Dim rb0pt0 As Point3d = New Point3d(endEffectorTip)
    rb0pt0.Transform(t_rb0)
    
    Dim c As New EndEffectorConstraintPt(rb)
    c.rb0pt0 = rb0pt0
    c.tgtpt0 = New Point3d(target)

    constraint = c
# ---------- end end_effector_point ----------
hinge = VBScript(rb0=item_2.Item, rb1=item_2.Item1, axis=crv)  # -> out, constraint; inputs axis: Line
# ---------- hinge: VB usings ----------
Class HingeConstraint
  Public Const code = "hin"
  Public rb0 As Object
  Public rb1 As Object
  Public rb0pt0 As Point3d
  Public rb0pt1 As Point3d
  Public rb1pt0 As Point3d
  Public rb1pt1 As Point3d

  Public Sub New(ByRef _rb0, ByRef _rb1)
    rb0 = _rb0
    rb1 = _rb1
  End Sub

End Class
# ---------- hinge: VB ----------
    Dim t_rb0 As Transform = Rhino.Geometry.Transform.ChangeBasis(Rhino.Geometry.Plane.WorldXY, rb0.plane)
    Dim t_rb1 As Transform = Rhino.Geometry.Transform.ChangeBasis(Rhino.Geometry.Plane.WorldXY, rb1.plane)
    Dim rb0pt0 As Point3d = New Point3d(axis.From())
    Dim rb0pt1 As Point3d = New Point3d(axis.To())
    Dim rb1pt0 As Point3d = New Point3d(axis.From())
    Dim rb1pt1 As Point3d = New Point3d(axis.To())
    rb0pt0.Transform(t_rb0)
    rb0pt1.Transform(t_rb0)
    rb1pt0.Transform(t_rb1)
    rb1pt1.Transform(t_rb1)

    Dim c As New HingeConstraint(rb0, rb1)
    c.rb0pt0 = rb0pt0
    c.rb0pt1 = rb0pt1
    c.rb1pt0 = rb1pt0
    c.rb1pt1 = rb1pt1

    constraint = c
# ---------- end hinge ----------
end_effector_point_2 = VBScript(rb=item.Item6, endEffectorTip=pt, target=target_pt)  # -> out, constraint; inputs endEffectorTip: Point3d, target: Point3d; same code as end_effector_point
fixed = VBScript(Rb0=item.Item, Rb1=item.Item1)  # -> Out, Constraint
ground = VBScript(rb=item_2.Item)  # -> out, A
# ---------- ground: VB usings ----------
Class GroundConstraint
  Public Const code = "gnd"
  Public rb0 As Object
  
  Public Sub New(ByRef rb)
    rb0 = rb
  End Sub
  
End Class
# ---------- ground: VB ----------
    A = New GroundConstraint(rb)
    print(A.rb0.guid.ToString())

    Dim ptO As Point3d = A.rb0.plane.Origin()

    Dim vecX As Vector3d = A.rb0.plane.XAxis()
    vecX.Unitize()
    Dim ptX As Point3d = ptO + vecX
    Dim vecY As Vector3d = A.rb0.plane.YAxis()
    vecY.Unitize()
    Dim ptY As Point3d = ptO + vecY

    print(ptO.ToString())
    print(ptX.ToString())
    print(ptY.ToString())
# ---------- end ground ----------
hinge_2 = VBScript(rb0=shift_2, rb1=shift, axis=crv_2)  # -> out, constraint; inputs axis: Line; same code as hinge
xy_3 = XYPlane(Origin=Point(0, 0, 0))
ground_2 = VBScript(rb=item.Item)  # -> out, A; same code as ground
subtraction_2 = Subtraction(A=lng, B=1)
multiplication = Multiplication(A=Slider(1, range=0..1), B=lng)
min = Minimum(A=multiplication, B=subtraction_2)
item_3 = ListItem(List=file, Index=min, Wrap=True)
orient = Orient(Geometry=geo_3, Source=prot_2, Target=xy_3)  # -> Geometry, Transform
move = Move(Motion=Vector(0, 0, 10))  # -> Geometry, Transform
ik = VBScript(rbs=rigid_body_2.rb, constraints=[ground.A, hinge.constraint, end_effector_point.constraint])  # -> out, A; inputs rbs: list, constraints: list
# ---------- ik: VB ----------
    Dim rbDict As New Dictionary(Of String, Integer)

    print("RigidBodyCount = " + rbs.count().ToString())
    Dim index As Integer = 0
    For Each rb As Object In rbs
      Dim code As String = rb.code() + ","
      Dim stateArray As Double() = rb.GetStateArray()
      code += String.Join(",", stateArray)
      print(code)
      'Add Rigid Body to Dictionary
      rbDict.Add(rb.guid.ToString(), index)
      index += 1
    Next

    For Each c As Object In constraints
      Dim code As String = c.code()
      Dim codeLine As String


      If code = "gnd" Then
        'Ground Constraint Output
        codeLine = code + "," + rbDict.Item(c.rb0.guid.ToString()).ToString()
      Else If  code = "hin" Then
        'Hinge Constraint Output
        codeLine = code + "," + FindRBID(c.rb0, rbDict) + "," + FindRBID(c.rb1, rbDict)
        codeLine += "," + PointToString(c.rb0pt0)
        codeLine += "," + PointToString(c.rb0pt1)
        codeLine += "," + PointToString(c.rb1pt0)
        codeLine += "," + PointToString(c.rb1pt1)
      Else If  code = "endPt" Then
        codeLine = code + "," + FindRBID(c.rb0, rbDict)
        codeLine += "," + PointToString(c.rb0pt0)
        codeLine += "," + PointToString(c.tgtpt0)
      Else
        'Not a known constraint
        Continue For
      End If


      print(codeLine)
    Next
# ---------- ik: VB additional code ----------
  Function FindRBID(rb, rbDict) As String
    'Print(rb.guid.ToString())
    Return rbDict.Item(rb.guid.ToString()).ToString()
  End Function

  Function PointToString(pt As Point3d) As String
    Return pt.X.ToString + "," + pt.Y.ToString + "," + pt.Z.ToString
  End Function
# ---------- end ik ----------
lng_2 = ListLength(List=log)
split = TextSplit(Text=item_3, Separators=",")
item_4 = ListItem(List=log, Index=Slider(42, range=0..100), Wrap=True)
mesh = Mesh(orient.Geometry)
panel_2 = Panel(subtraction)
steps_2 = Panel(lng_2)
rep = ReplaceText(Text=split, Find=" ", RecursiveReplace=False)
split_2 = TextSplit(Text=item_4, Separators=",")
ik_2 = VBScript(rbs=rigid_body.rb, constraints=flatten([ground_2.A, hinge_2.constraint, end_effector_point_2.constraint]))  # -> out, A; inputs rbs: list, constraints: list
# ---------- ik_2: VB ----------
    Dim rbDict As New Dictionary(Of String, Integer)

    print("RigidBodyCount = " + rbs.count().ToString())
    Dim index As Integer = 0
    For Each rb As Object In rbs
      Dim code As String = rb.code() + ","
      Dim stateArray As Double() = rb.GetStateArray()
      code += String.Join(",", stateArray)
      print(code)
      'Add Rigid Body to Dictionary
      rbDict.Add(rb.guid.ToString(), index)
      index += 1
    Next

    For Each c As Object In constraints
      Dim code As String = c.code()
      Dim codeLine As String


      If code = "gnd" Then
        'Ground Constraint Output
        codeLine = code + "," + rbDict.Item(c.rb0.guid.ToString()).ToString()
      Else If  code = "hin" Then
        'Hinge Constraint Output
        codeLine = code + "," + FindRBID(c.rb0, rbDict) + "," + FindRBID(c.rb1, rbDict)
        codeLine += "," + PointToString(c.rb0pt0)
        codeLine += "," + PointToString(c.rb0pt1)
        codeLine += "," + PointToString(c.rb1pt0)
        codeLine += "," + PointToString(c.rb1pt1)
      Else If  code = "endPt" Then
        codeLine = code + "," + FindRBID(c.rb0, rbDict)
        codeLine += "," + PointToString(c.rb0pt0)
        codeLine += "," + PointToString(c.tgtpt0)
      Else
        'Not a known constraint
        Continue For
      End If


      print(codeLine)
    Next
# ---------- ik_2: VB additional code ----------
  Function FindRBID(rb, rbDict) As String
    'Print(rb.guid.ToString())
    Return rbDict.Item(rb.guid.ToString()).ToString()
  End Function

  Function PointToString(pt As Point3d) As String
    'Return pt.X.ToString("0.#######") + "," + pt.Y.ToString("0.#######") + "," + pt.Z.ToString("0.#######")
    Return pt.X.ToString("e") + "," + pt.Y.ToString("e") + "," + pt.Z.ToString("e")
  End Function
# ---------- end ik_2 ----------
dist = Distance()
panel_3 = Panel(rigid_body_2.out)
fixed_2 = VBScript(Rb0=item_2.Item, Rb1=item_2.Item1)  # -> Out, Constraint
rep_2 = ReplaceText(Text=split_2, Find=" ", RecursiveReplace=False)
num = Number(rep)
graft = GraftTree(Tree=num, IncludeEmptyLists=True, IncludeNullItems=True)  # -> simplify(Tree)
path_mapper = PathMapper(graft, source="{A}", target="{floor(A/6)}(A%6)")
panel_4 = Panel(num)
item_5 = ListItem(List=path_mapper, Index=0, Wrap=False)  # -> Item, Item1, Item2, Item3, Item4, Item5
pt_4 = ConstructPoint(XCoordinate=item_5.Item, YCoordinate=item_5.Item1, ZCoordinate=item_5.Item2)
panel_5 = Panel(item_5.Item4)
xy_4 = XYPlane(Origin=pt_4)
rx = Number(item_5.Item3)
ry = Number(item_5.Item4)
rz = Number(item_5.Item5)
num_2 = Number(path_mapper)
pln = Plane(xy_4)
pln_2 = Plane(xy_4)
deplane = DeconstructPlane(Plane=pln)  # -> Origin, XAxis, YAxis, ZAxis
deplane_2 = DeconstructPlane(Plane=pln_2)  # -> Origin, XAxis, YAxis, ZAxis
rot3d = Rotate3D(Geometry=pln, Angle=rz, Center=deplane.Origin, Axis=deplane.ZAxis)  # -> Geometry, Transform
rot3d_2 = Rotate3D(Geometry=pln_2, Angle=rx, Center=deplane_2.Origin, Axis=deplane_2.XAxis)  # -> Geometry, Transform
pln_3 = Plane(rot3d.Geometry)
pln_4 = Plane(rot3d_2.Geometry)
deplane_3 = DeconstructPlane(Plane=pln_3)  # -> Origin, XAxis, YAxis, ZAxis
deplane_4 = DeconstructPlane(Plane=pln_4)  # -> Origin, XAxis, YAxis, ZAxis
rot3d_3 = Rotate3D(Geometry=pln_3, Angle=ry, Center=deplane_3.Origin, Axis=deplane_3.YAxis)  # -> Geometry, Transform
rot3d_4 = Rotate3D(Geometry=pln_4, Angle=ry, Center=deplane_4.Origin, Axis=deplane_4.YAxis)  # -> Geometry, Transform
pln_5 = Plane(rot3d_3.Geometry)
deplane_5 = DeconstructPlane(Plane=pln_5)  # -> Origin, XAxis, YAxis, ZAxis
pln_6 = Plane(rot3d_4.Geometry)
deplane_6 = DeconstructPlane(Plane=pln_6)  # -> Origin, XAxis, YAxis, ZAxis
send_to_optimizer = Panel(ik.out)
rot3d_5 = Rotate3D(Geometry=pln_5, Angle=rx, Center=deplane_5.Origin, Axis=deplane_5.XAxis)  # -> Geometry, Transform
num_3 = Number(num_2)
state_to_planes = StateToPlanes(num=rep_2)  # -> d, G
send_to_optimizer_2 = Panel(ik_2.out)
rot3d_6 = Rotate3D(Geometry=pln_6, Angle=rz, Center=deplane_6.Origin, Axis=deplane_6.ZAxis)  # -> Geometry, Transform
visualiuze_rb = VBScript(plane=flatten(rot3d_5.Geometry), rb=rigid_body.rb)  # -> out, A; inputs plane: Plane
# ---------- visualiuze_rb: VB ----------
    Dim t As Transform = Rhino.Geometry.Transform.ChangeBasis(plane, Rhino.Geometry.Plane.WorldXY)
    Dim _mesh As Rhino.Geometry.Mesh = rb.mesh.Duplicate()
    _mesh.Transform(t)
    A = _mesh
# ---------- end visualiuze_rb ----------
visualiuze_rb_2 = VBScript(plane=flatten(rot3d_6.Geometry), rb=rigid_body.rb)  # -> out, A; inputs plane: Plane; same code as visualiuze_rb
panel_6 = Panel(num_3)
preview = CustomPreview(Geometry=visualiuze_rb_2.A, Material=ColourSwatch(SwatchColor=RGB(178, 50, 50)))
visualiuze_rb_3 = VBScript(plane=flatten(state_to_planes.G), rb=rigid_body_2.rb)  # -> out, A; inputs plane: Plane; same code as visualiuze_rb

# ==== cluster StateToPlanes
num = ClusterInput()
num_2 = Number(num)
graft = GraftTree(Tree=num_2, IncludeEmptyLists=True, IncludeNullItems=True)  # -> simplify(Tree)
panel = Panel(num_2)
path_mapper = PathMapper(graft, source="{A}", target="{floor(A/6)}(A%6)")
num_3 = Number(path_mapper)
item = ListItem(List=path_mapper, Index=0, Wrap=False)  # -> Item, Item1, Item2, Item3, Item4, Item5
pt = ConstructPoint(XCoordinate=item.Item, YCoordinate=item.Item1, ZCoordinate=item.Item2)
d = ClusterOutput(num_3)  # d
xy = XYPlane(Origin=pt)
rx = Number(item.Item3)
ry = Number(item.Item4)
rz = Number(item.Item5)
pln = Plane(xy)
deplane = DeconstructPlane(Plane=pln)  # -> Origin, XAxis, YAxis, ZAxis
rot3d = Rotate3D(Geometry=pln, Angle=rz, Center=deplane.Origin, Axis=deplane.ZAxis)  # -> Geometry, Transform
pln_2 = Plane(rot3d.Geometry)
deplane_2 = DeconstructPlane(Plane=pln_2)  # -> Origin, XAxis, YAxis, ZAxis
rot3d_2 = Rotate3D(Geometry=pln_2, Angle=ry, Center=deplane_2.Origin, Axis=deplane_2.YAxis)  # -> Geometry, Transform
pln_3 = Plane(rot3d_2.Geometry)
deplane_3 = DeconstructPlane(Plane=pln_3)  # -> Origin, XAxis, YAxis, ZAxis
rot3d_3 = Rotate3D(Geometry=pln_3, Angle=rx, Center=deplane_3.Origin, Axis=deplane_3.XAxis)  # -> Geometry, Transform
G = ClusterOutput(rot3d_3.Geometry)
