# Grasshopper definition SimPackager_V3_3DLink.gh (Grasshopper 1.0.7)
# plug-ins: Firefly.X

timer = Timer(TimerInterval=6000, Target=counter)  # disabled
counter = Counter(CountDirection=True, Step=-1, StartStop=Toggle(True), Reset=Toggle(False), OptionalCounterDomain=Domain(0, 100))

geo_slide = Geometry(<brep referenced from the Rhino model>)
geo_arm = Geometry(<brep referenced from the Rhino model>)
geo_base = Geometry(<brep referenced from the Rhino model>)
geo_arm_2 = Geometry(<brep referenced from the Rhino model>)
number_slider = Slider(0, range=0..360)
pt = Point(<point referenced from the Rhino model>)
volume = Volume(Geometry=geo_arm)  # -> Volume, Centroid
volume_2 = Volume(Geometry=geo_slide)  # -> Volume, Centroid
volume_3 = Volume(Geometry=geo_base)  # -> Volume, Centroid
volume_4 = Volume(Geometry=geo_arm_2)  # -> Volume, Centroid
pt_2 = Point(<point referenced from the Rhino model>)
xy = XYPlane(Origin=volume.Centroid)
xy_2 = XYPlane(Origin=volume_2.Centroid)
xy_3 = XYPlane(Origin=volume_3.Centroid)
xy_4 = XYPlane(Origin=volume_4.Centroid)
subtraction = Subtraction(A=Slider(100, range=0..100), B=counter)
rigid_body = VBScript(mesh=geo_arm, id=geo_arm, plane=xy)  # -> out, rb; inputs mesh: Mesh, id: Guid, plane: Plane
# ---------- rigid_body: VB usings ----------
Public Class RigidBody
  Public const code = "rb"
  Public guid As GUID
  Public mesh As Mesh
  Public plane As Plane

  Public Sub New(ByRef _mesh As Mesh, ByRef _plane As Plane)

    plane = _plane
    Dim t_rb0 As Transform = Rhino.Geometry.Transform.ChangeBasis(Rhino.Geometry.Plane.WorldXY, _plane)
    _mesh.Transform(t_rb0)
    mesh = _mesh
  End Sub

  Public Function Quaternion() As Quaternion
    Return Quaternion.Rotation(Rhino.Geometry.Plane.WorldXY, plane)
  End Function

  ''' <summary>
  ''' Returns the state of the rigid body in an array. XYZABCD
  ''' </summary>
  ''' <returns></returns>
  Public Function GetStateArray() As Double()
    Dim q As Quaternion = Quaternion()
    Dim p As Point3D = plane.origin
    Dim stateArray As Double() = New Double() {p.X, p.Y, p.Z, q.A, q.B, q.C, q.D}
    Return stateArray
  End Function



End Class
# ---------- rigid_body: VB ----------
    If mesh Is Nothing Then Return

    rb = New RigidBody(mesh, plane)
    rb.guid = id

    Print(rb.guid.ToString())

    Dim stateArray As Double() = rb.GetStateArray()
    Print(String.Join(",", stateArray))
# ---------- end rigid_body ----------
rigid_body_2 = VBScript(mesh=geo_slide, id=geo_slide, plane=xy_2)  # -> out, rb; inputs mesh: Mesh, id: Guid, plane: Plane; same code as rigid_body
panel = Panel(counter)
rigid_body_3 = VBScript(mesh=geo_base, id=geo_base, plane=xy_3)  # -> out, rb; inputs mesh: Mesh, id: Guid, plane: Plane; same code as rigid_body
rigid_body_4 = VBScript(mesh=geo_arm_2, id=geo_arm_2, plane=xy_4)  # -> out, rb; inputs mesh: Mesh, id: Guid, plane: Plane; same code as rigid_body
multiplication = Multiplication(A=counter, B=3.6)
num = Number(multiplication)
neg = Negative(Value=num)
vb = VBScript(x=panel)  # -> A
# ---------- vb: C# ----------
A = x.ToString("D3")
# ---------- end vb ----------
range = Range(Domain=Domain(0, 1), Steps=10)
dam = DataDam(DataA=vb, BufferDelay=20000000, BufferMode=2)
dam_2 = DataDam(DataA=dam, BufferDelay=20000000, BufferMode=2)
concat = Concatenate(FragmentA="Anim_1_", FragmentB=dam_2)
panel_2 = Panel(concat)
panel_3 = Panel(panel_2)
crv_hinge_axis = Curve(<curve referenced from the Rhino model>)
crv = Curve(crv_hinge_axis)
rotax = RotateAxis(Geometry=pt_2, Angle=degrees(neg), Axis=crv)  # -> Geometry, Transform
panel_4 = Panel(multiplication)
crv_hinge_axis_2 = Curve(<curve referenced from the Rhino model>)
crv_2 = Curve(crv_hinge_axis_2)
rotax_2 = RotateAxis(Geometry=pt, Angle=degrees(num), Axis=crv_2)  # -> Geometry, Transform
crv_hinge_axis_3 = Curve(<curve referenced from the Rhino model>)
crv_hinge_axis_4 = Curve(<curve referenced from the Rhino model>)
end_effector_plane = VBScript(rb=rigid_body_4.rb, endEffectorPlane=pt, targetPlane=rotax_2.Geometry, ProgressiveAlpha="2", ConstraintType="1")  # -> out, constraint; inputs endEffectorPlane: Plane, targetPlane: Plane
# ---------- end_effector_plane: VB usings ----------
Class EndEffectorConstraintPt
  Public Const code = "target"
  Public rb0 As Object
  Public rb0pt0 As Point3d
  Public rb0pt1 As Point3d
  Public rb0pt2 As Point3d
  Public tgtpt0, tgtpt1, tgtpt2 As Point3d
  Public ProgressiveAlpha As Double
  Public numConstraintPoints As Integer

  Public Sub New(ByRef _rb0)
    rb0 = _rb0
  End Sub

End Class
# ---------- end_effector_plane: VB ----------
    If rb Is Nothing Then Return
    
    'Create the constraint object
    Dim c As New EndEffectorConstraintPt(rb)

    'Create Transformation to relocate the EndEffector Point to Local Coordinates
    Dim t_rb0 As Transform = Rhino.Geometry.Transform.ChangeBasis(Rhino.Geometry.Plane.WorldXY, rb.plane)

    Dim rb0pt0 As Point3d = New Point3d(endEffectorPlane.Origin())
    Dim rb0pt1 As Point3d = New Point3d(endEffectorPlane.Origin() + endEffectorPlane.XAxis())
    Dim rb0pt2 As Point3d = New Point3d(endEffectorPlane.Origin() + endEffectorPlane.YAxis())


    rb0pt0.Transform(t_rb0)
    rb0pt1.Transform(t_rb0)
    rb0pt2.Transform(t_rb0)

    c.rb0pt0 = rb0pt0
    c.rb0pt1 = rb0pt1
    c.rb0pt2 = rb0pt2

    'Record the world points

    c.tgtpt0 = New Point3d(targetPlane.Origin)
    c.tgtpt1 = New Point3d(targetPlane.Origin + targetPlane.XAxis)
    c.tgtpt2 = New Point3d(targetPlane.Origin + targetPlane.YAxis)

    'Record other values
    c.ProgressiveAlpha = ProgressiveAlpha
    c.numConstraintPoints = ConstraintType


    constraint = c
# ---------- end end_effector_plane ----------
end_effector_plane_2 = VBScript(rb=rigid_body.rb, endEffectorPlane=pt_2, targetPlane=rotax.Geometry, ProgressiveAlpha="2", ConstraintType="1")  # -> out, constraint; inputs endEffectorPlane: Plane, targetPlane: Plane; same code as end_effector_plane
ground = VBScript(rb=rigid_body_3.rb)  # -> out, constraint
# ---------- ground: VB usings ----------
Class GroundConstraint
  Public Const code = "gnd"
  Public rb0 As Object

  Public Sub New(ByRef rb)
    rb0 = rb
  End Sub

End Class
# ---------- ground: VB ----------
    If rb Is Nothing Then Return

    Dim A = New GroundConstraint(rb)
    print(A.rb0.guid.ToString())

    Dim ptO As Point3d = A.rb0.plane.Origin()

    Dim vecX As Vector3d = A.rb0.plane.XAxis()
    vecX.Unitize()
    Dim ptX As Point3d = ptO + vecX
    Dim vecY As Vector3d = A.rb0.plane.YAxis()
    vecY.Unitize()
    Dim ptY As Point3d = ptO + vecY

    print(ptO.ToString())
    print(ptX.ToString())
    print(ptY.ToString())

    constraint = A
# ---------- end ground ----------
concat_2 = Concatenate()
hinge = VBScript(rb0=rigid_body_3.rb, rb1=rigid_body.rb, axis=crv_hinge_axis)  # -> out, constraint; inputs axis: Line
# ---------- hinge: VB usings ----------
Class HingeConstraint
  Public Const code = "hin"
  Public rb0 As Object
  Public rb1 As Object
  Public rb0pt0 As Point3d
  Public rb0pt1 As Point3d
  Public rb1pt0 As Point3d
  Public rb1pt1 As Point3d

  Public Sub New(ByRef _rb0, ByRef _rb1)
    rb0 = _rb0
    rb1 = _rb1
  End Sub

End Class
# ---------- hinge: VB ----------
    If rb0 Is Nothing Then Return
    If rb1 Is Nothing Then Return
    
    Dim t_rb0 As Transform = Rhino.Geometry.Transform.ChangeBasis(Rhino.Geometry.Plane.WorldXY, rb0.plane)
    Dim t_rb1 As Transform = Rhino.Geometry.Transform.ChangeBasis(Rhino.Geometry.Plane.WorldXY, rb1.plane)
    Dim rb0pt0 As Point3d = New Point3d(axis.From())
    Dim rb0pt1 As Point3d = New Point3d(axis.To())
    Dim rb1pt0 As Point3d = New Point3d(axis.From())
    Dim rb1pt1 As Point3d = New Point3d(axis.To())
    rb0pt0.Transform(t_rb0)
    rb0pt1.Transform(t_rb0)
    rb1pt0.Transform(t_rb1)
    rb1pt1.Transform(t_rb1)

    Dim c As New HingeConstraint(rb0, rb1)
    c.rb0pt0 = rb0pt0
    c.rb0pt1 = rb0pt1
    c.rb1pt0 = rb1pt0
    c.rb1pt1 = rb1pt1

    constraint = c
# ---------- end hinge ----------
merge = Merge(Data1=rigid_body_3.rb, Data2=rigid_body.rb, Data3=rigid_body_4.rb, Data4=rigid_body_2.rb)
hinge_2 = VBScript(rb0=rigid_body_3.rb, rb1=rigid_body_4.rb, axis=crv_hinge_axis_2)  # -> out, constraint; inputs axis: Line; same code as hinge
hinge_3 = VBScript(rb0=rigid_body_4.rb, rb1=rigid_body_2.rb, axis=crv_hinge_axis_3)  # -> out, constraint; inputs axis: Line; same code as hinge
hinge_4 = VBScript(rb0=rigid_body.rb, rb1=rigid_body_2.rb, axis=crv_hinge_axis_4)  # -> out, constraint; inputs axis: Line; same code as hinge
currentviewcapture = CurrentViewCapture(
    PathToFile="D:\test",
    FileName=panel_3,
    Extension="jpg",
    Width=Slider(2000, range=100..2600),
    Height=Slider(1500, range=100..2600),
    DrawGrid=Toggle(False),
    DrawWorldAxes=Toggle(False),
    DrawCPlaneAxes=Toggle(False),
    Activate=Toggle(False))  # -> out, A
# ---------- currentviewcapture: VB ----------
    ' Script created by Eduard Haiman haiman-ed@yandex.ru
    ' Write to PathToFile like C:\Users , without final "\"
    ' Extension can be bmp, tga, jpg, pcx, png or tif
    ' Don't forget to set Activate to  "False"  before close the GH file

    If PathToFile = ""
      print("Path " & PathToFile & " does not exist!")
      Return
      'Else
      'If Dir(PathToFile & "\") <> "" Then
      'Else
      '  print("Path """ & PathToFile & "\" & """ does not exist!")
      '  Return
      'End If
    End If

    Dim DrawGridVB As String = "No"
    Dim DrawWorldAxesVB As String = "No"
    Dim DrawCPlaneAxesVB As String = "No"
    Dim FullName As String = PathToFile & "\" & FileName & "." & Extension


    If DrawGrid Then
      DrawGridVB = "Yes"
    Else
      DrawGridVB = "No"
    End If

    If DrawWorldAxes Then
      DrawWorldAxesVB = "Yes"
    Else
      DrawWorldAxesVB = "No"
    End If

    If DrawCPlaneAxes Then
      DrawCPlaneAxesVB = "Yes"
    Else
      DrawCPlaneAxesVB = "No"
    End If

    print("FullName " & FullName)
    print("Width=" & Width & " Height=" & Height)
    print("DrawGrid=" & DrawGridVB & " DrawWorldAxes=" & DrawWorldAxesVB & " DrawCPlaneAxes=" & DrawCPlaneAxesVB)

    If Activate Then
      app.RunScript("-viewcapturetofile """ & FullName & """ W=" & Width & " H=" & Height & " DrawGrid=" & DrawGridVB & " DrawWorldAxes=" & DrawWorldAxesVB & " DrawCPlaneAxes=" & DrawCPlaneAxesVB & " _Enter")
      print("Active...")

      If Dir(FullName) <> "" Then
        print(FileName & "." & Extension & " was CREATED!")
      Else
        print(FileName & "." & Extension & " was NOT created!")
      End If


    Else print("Inactive...")
    End If
# ---------- end currentviewcapture ----------
panel_5 = Panel(currentviewcapture.out)
merge_2 = Merge(
    Data1=ground.constraint,
    Data2=hinge.constraint,
    Data3=hinge_2.constraint,
    Data4=hinge_3.constraint,
    Data5=hinge_4.constraint,
    Data6=end_effector_plane.constraint,
    Data7=end_effector_plane_2.constraint)

# ---- group: Screen cap Responsive Setting
settings = VBScript(progressiveEnergyThreshold="1e-2", finalEnergyThreshold="1e-10", progresiveSteps="10", finalSteps="4000", verbose="0")  # -> out, setting
# ---------- settings: VB usings ----------
Class OptimizationSetting
  Public progressiveEnergyThreshold As Double
  Public finalEnergyThreshold As Double
  Public progresiveSteps As Integer
  Public finalSteps As Integer
  Public logFile As String = ""
  Public verbose As Integer
  
End Class
# ---------- settings: VB ----------
    Dim s = New OptimizationSetting()
    s.progressiveEnergyThreshold = progressiveEnergyThreshold
    s.finalEnergyThreshold = finalEnergyThreshold
    s.progresiveSteps = progresiveSteps
    s.finalSteps = finalSteps
    s.logFile = logFile
    s.verbose = verbose
    
    setting = s
# ---------- end settings ----------

# ---- group: Fast Responsive Setting
settings_2 = VBScript(progressiveEnergyThreshold="1e-2", finalEnergyThreshold="1e-4", progresiveSteps="5", finalSteps="100", verbose="0")  # -> out, setting; same code as settings

# ----
ik = VBScript(rbs=merge, constraints=merge_2, setting=settings.setting)  # -> out, SimResetString, SimUpdateString; inputs rbs: list, constraints: list
# ---------- ik: VB ----------
    If (rbs.count = 0) Then Return
    
    Dim rbDict As New Dictionary(Of String, Integer)

    Dim _SimResetString As String = "reset;"
    Dim _SimUpdateString As String = "update;"

    'Encode Rifig Bodies
    print("RigidBodyCount=" + rbs.count().ToString())
    _SimResetString += "RigidBodyCount=" + rbs.count().ToString() + ";"
    Dim index As Integer = 0
    For Each rb As Object In rbs
      Dim code As String = rb.code() + ","
      Dim stateArray As Double() = rb.GetStateArray()
      code += String.Join(",", stateArray)
      print(code)
      _SimResetString += code + ";"
      'Add Rigid Body to Dictionary
      rbDict.Add(rb.guid.ToString(), index)
      index += 1
    Next

    'Encode Simulation Parameters
    _SimResetString += "param_progressiveEnergyThreshold=" + setting.progressiveEnergyThreshold.ToString() + ";"
    _SimResetString += "param_finalEnergyThreshold=" + setting.finalEnergyThreshold.ToString() + ";"
    _SimResetString += "param_progresiveSteps=" + setting.progresiveSteps.ToString() + ";"
    _SimResetString += "param_finalSteps=" + setting.finalSteps.ToString() + ";"
    _SimResetString += "param_logFile=" + setting.logFile.ToString() + ";"
    _SimResetString += "param_verbose=" + setting.verbose.ToString() + ";"

    ' Encode Constraints
    Dim constraintID As Integer = 0
    For Each c As Object In constraints
      Dim code As String = c.code()
      Dim codeLine As String

      If code = "gnd" Then
        'Ground Constraint Output
        codeLine = code + "," + rbDict.Item(c.rb0.guid.ToString()).ToString()
        codeLine += "," + constraintID.ToString()
      Else If  code = "hin" Then
        'Hinge Constraint Output
        codeLine = code + "," + FindRBID(c.rb0, rbDict) + "," + FindRBID(c.rb1, rbDict)
        codeLine += "," + PointToString(c.rb0pt0)
        codeLine += "," + PointToString(c.rb0pt1)
        codeLine += "," + PointToString(c.rb1pt0)
        codeLine += "," + PointToString(c.rb1pt1)
        codeLine += "," + constraintID.ToString()
      Else If  code = "ptOnLine" Then
        'Hinge Constraint Output
        codeLine = code + "," + FindRBID(c.rb0, rbDict) + "," + FindRBID(c.rb1, rbDict)
        codeLine += "," + PointToString(c.rb0pt0)
        codeLine += "," + PointToString(c.rb0pt1)
        codeLine += "," + PointToString(c.rb1pt0)
        codeLine += "," + constraintID.ToString()
      Else If  code = "target" Then
        codeLine = code + "," + FindRBID(c.rb0, rbDict)
        codeLine += "," + PointToString(c.rb0pt0)
        codeLine += "," + PointToString(c.rb0pt1)
        codeLine += "," + PointToString(c.rb0pt2)
        codeLine += "," + PointToString(c.tgtpt0)
        codeLine += "," + PointToString(c.tgtpt1)
        codeLine += "," + PointToString(c.tgtpt2)
        codeLine += "," + c.ProgressiveAlpha.ToString()
        codeLine += "," + c.numConstraintPoints.ToString()
        codeLine += "," + constraintID.ToString()
      Else
        'Not a known constraint
        Continue For
      End If


      print(codeLine)
      _SimResetString += codeLine + ";"
      _SimUpdateString += codeLine + ";"

      constraintID += 1
    Next

    SimResetString = _SimResetString
    SimUpdateString = _SimUpdateString
# ---------- ik: VB additional code ----------
  Function FindRBID(rb, rbDict) As String
    'Print(rb.guid.ToString())
    Return rbDict.Item(rb.guid.ToString()).ToString()
  End Function

  Function PointToString(pt As Point3d) As String
    'Return pt.X.ToString("0.#######") + "," + pt.Y.ToString("0.#######") + "," + pt.Z.ToString("0.#######")
    Return pt.X.ToString("e") + "," + pt.Y.ToString("e") + "," + pt.Z.ToString("e")
  End Function
# ---------- end ik ----------

# ---- group: WebSocket Communication
reset_simulation = Button()
websocket_client_start = WebsocketClientStart(Address="ws://localhost:9002", InitalMessage=ik.SimResetString, Reset=reset_simulation)
websocket_client_receiver = WebsocketClientReceiver(WebsocketObjects=websocket_client_start, AutoUpdate=True)  # -> Message, Status
websocket_client_sender = WebsocketClientSender(WebsocketObjects=websocket_client_start, Message=ik.SimUpdateString)

# ----
panel_6 = Panel(websocket_client_receiver.Message)

# ---- group: Visualization
solution_visualization = SolutionVisualization(T=websocket_client_receiver.Message, rb=merge)
preview = CustomPreview(Geometry=solution_visualization, Material=ColourSwatch(SwatchColor=RGB(178, 123, 50)))

# ==== cluster SolutionVisualization
T = ClusterInput()
split = TextSplit(Text=T, Separators=",")
rep = ReplaceText(Text=split, Find=" ", RecursiveReplace=False)
state_to_planes = StateToPlanes(num=rep)
rb = ClusterInput()
visualiuze_rb = VBScript(plane=flatten(state_to_planes), rb=rb)  # -> out, A; inputs plane: Plane
# ---------- visualiuze_rb: VB ----------
    Dim t As Transform = Rhino.Geometry.Transform.ChangeBasis(plane, Rhino.Geometry.Plane.WorldXY)
    Dim _mesh As Rhino.Geometry.Mesh = rb.mesh.Duplicate()
    _mesh.Transform(t)
    A = _mesh
# ---------- end visualiuze_rb ----------
A = ClusterOutput(visualiuze_rb.A)

# ==== cluster StateToPlanes
num = ClusterInput()
num_2 = Number(num)
graft = GraftTree(Tree=num_2, IncludeEmptyLists=True, IncludeNullItems=True)  # -> simplify(Tree)
path_mapper = PathMapper(graft, source="{A}", target="{floor(A/6)}(A%6)")
item = ListItem(List=path_mapper, Index=0, Wrap=False)  # -> Item, Item1, Item2, Item3, Item4, Item5
pt = ConstructPoint(XCoordinate=item.Item, YCoordinate=item.Item1, ZCoordinate=item.Item2)
xy = XYPlane(Origin=pt)
rx = Number(item.Item3)
ry = Number(item.Item4)
rz = Number(item.Item5)
pln = Plane(xy)
deplane = DeconstructPlane(Plane=pln)  # -> Origin, XAxis, YAxis, ZAxis
rot3d = Rotate3D(Geometry=pln, Angle=rx, Center=deplane.Origin, Axis=deplane.XAxis)  # -> Geometry, Transform
pln_2 = Plane(rot3d.Geometry)
deplane_2 = DeconstructPlane(Plane=pln_2)  # -> Origin, XAxis, YAxis, ZAxis
rot3d_2 = Rotate3D(Geometry=pln_2, Angle=ry, Center=deplane_2.Origin, Axis=deplane_2.YAxis)  # -> Geometry, Transform
pln_3 = Plane(rot3d_2.Geometry)
deplane_3 = DeconstructPlane(Plane=pln_3)  # -> Origin, XAxis, YAxis, ZAxis
rot3d_3 = Rotate3D(Geometry=pln_3, Angle=rz, Center=deplane_3.Origin, Axis=deplane_3.ZAxis)  # -> Geometry, Transform
G = ClusterOutput(rot3d_3.Geometry)
