# Grasshopper definition SimPackager_V3_Demo_6DofArm.gh (Grasshopper 1.0.7)

geo = Geometry([<brep referenced from the Rhino model> x7])
geo_2 = Geometry(geo)
volume = Volume(Geometry=geo_2)  # -> Volume, Centroid
xy = XYPlane(Origin=volume.Centroid)
rigid_body = VBScript(mesh=geo_2, id=geo_2, plane=xy)  # -> out, rb; inputs mesh: Mesh, id: Guid, plane: Plane
# ---------- rigid_body: VB usings ----------
Public Class RigidBody
  Public const code = "rb"
  Public guid As GUID
  Public mesh As Mesh
  Public plane As Plane

  Public Sub New(ByRef _mesh As Mesh, ByRef _plane As Plane)

    plane = _plane
    Dim t_rb0 As Transform = Rhino.Geometry.Transform.ChangeBasis(Rhino.Geometry.Plane.WorldXY, _plane)
    _mesh.Transform(t_rb0)
    mesh = _mesh
  End Sub

  Public Function Quaternion() As Quaternion
    Return Quaternion.Rotation(Rhino.Geometry.Plane.WorldXY, plane)
  End Function

  ''' <summary>
  ''' Returns the state of the rigid body in an array. XYZABCD
  ''' </summary>
  ''' <returns></returns>
  Public Function GetStateArray() As Double()
    Dim q As Quaternion = Quaternion()
    Dim p As Point3D = plane.origin
    Dim stateArray As Double() = New Double() {p.X, p.Y, p.Z, q.A, q.B, q.C, q.D}
    Return stateArray
  End Function



End Class
# ---------- rigid_body: VB ----------
    If mesh Is Nothing Then Return

    rb = New RigidBody(mesh, plane)
    rb.guid = id

    Print(rb.guid.ToString())

    Dim stateArray As Double() = rb.GetStateArray()
    Print(String.Join(",", stateArray))
# ---------- end rigid_body ----------
item = ListItem(List=rigid_body.rb, Index=0, Wrap=True)  # -> Item, Item1, Item2, Item3, Item4, Item5, Item6

panel = Panel("C:\Users\Victor\Documents\GitHub\comp-fab-a2-yck011522\RhinoPython\log.txt")
filter = StreamFilter(Gate=Toggle(False), Stream1=panel)

md_slider = MDSlider(
    SliderMode=0,
    slider_value=Point(0.1409748357, 0.627654285, 0.5),
    x_domain=Domain(0, 1),
    y_domain=Domain(0, 1),
    z_domain=Domain(0, 1))
srf = Surface(<surface referenced from the Rhino model>)
pt = Point(<point referenced from the Rhino model>)
xy_2 = XYPlane(Origin=pt)
preview = CustomPreview(Geometry=srf, Material=ColourSwatch(SwatchColor=RGB(199, 183, 163)))
evalsrf = EvaluateSurface(Surface=reparameterize(srf), Point=md_slider)  # -> Point, Normal, UDirection, VDirection, Frame
end_effector_plane = VBScript(
    rb=item.Item6,
    endEffectorPlane=xy_2,
    targetPlane=evalsrf.Frame,
    ProgressiveAlpha=Slider(10, range=0..400),
    ConstraintType=Slider(3, range=1..3))  # -> out, constraint; inputs endEffectorPlane: Plane, targetPlane: Plane
# ---------- end_effector_plane: VB usings ----------
Class EndEffectorConstraintPt
  Public Const code = "target"
  Public rb0 As Object
  Public rb0pt0 As Point3d
  Public rb0pt1 As Point3d
  Public rb0pt2 As Point3d
  Public tgtpt0, tgtpt1, tgtpt2 As Point3d
  Public ProgressiveAlpha As Double
  Public numConstraintPoints As Integer

  Public Sub New(ByRef _rb0)
    rb0 = _rb0
  End Sub

End Class
# ---------- end_effector_plane: VB ----------
    If rb Is Nothing Then Return
    
    'Create the constraint object
    Dim c As New EndEffectorConstraintPt(rb)

    'Create Transformation to relocate the EndEffector Point to Local Coordinates
    Dim t_rb0 As Transform = Rhino.Geometry.Transform.ChangeBasis(Rhino.Geometry.Plane.WorldXY, rb.plane)

    Dim rb0pt0 As Point3d = New Point3d(endEffectorPlane.Origin())
    Dim rb0pt1 As Point3d = New Point3d(endEffectorPlane.Origin() + endEffectorPlane.XAxis())
    Dim rb0pt2 As Point3d = New Point3d(endEffectorPlane.Origin() + endEffectorPlane.YAxis())


    rb0pt0.Transform(t_rb0)
    rb0pt1.Transform(t_rb0)
    rb0pt2.Transform(t_rb0)

    c.rb0pt0 = rb0pt0
    c.rb0pt1 = rb0pt1
    c.rb0pt2 = rb0pt2

    'Record the world points

    c.tgtpt0 = New Point3d(targetPlane.Origin)
    c.tgtpt1 = New Point3d(targetPlane.Origin + targetPlane.XAxis)
    c.tgtpt2 = New Point3d(targetPlane.Origin + targetPlane.YAxis)

    'Record other values
    c.ProgressiveAlpha = ProgressiveAlpha
    c.numConstraintPoints = ConstraintType


    constraint = c
# ---------- end end_effector_plane ----------

shift = ShiftList(List=rigid_body.rb, Shift=-1, Wrap=False)
shift_2 = ShiftList(List=rigid_body.rb, Shift=1, Wrap=False)
crv = Curve([<curve referenced from the Rhino model> x6])
hinge = VBScript(rb0=shift, rb1=shift_2, axis=crv)  # -> out, constraint; inputs axis: Line
# ---------- hinge: VB usings ----------
Class HingeConstraint
  Public Const code = "hin"
  Public rb0 As Object
  Public rb1 As Object
  Public rb0pt0 As Point3d
  Public rb0pt1 As Point3d
  Public rb1pt0 As Point3d
  Public rb1pt1 As Point3d

  Public Sub New(ByRef _rb0, ByRef _rb1)
    rb0 = _rb0
    rb1 = _rb1
  End Sub

End Class
# ---------- hinge: VB ----------
    If rb0 Is Nothing Then Return
    If rb1 Is Nothing Then Return
    
    Dim t_rb0 As Transform = Rhino.Geometry.Transform.ChangeBasis(Rhino.Geometry.Plane.WorldXY, rb0.plane)
    Dim t_rb1 As Transform = Rhino.Geometry.Transform.ChangeBasis(Rhino.Geometry.Plane.WorldXY, rb1.plane)
    Dim rb0pt0 As Point3d = New Point3d(axis.From())
    Dim rb0pt1 As Point3d = New Point3d(axis.To())
    Dim rb1pt0 As Point3d = New Point3d(axis.From())
    Dim rb1pt1 As Point3d = New Point3d(axis.To())
    rb0pt0.Transform(t_rb0)
    rb0pt1.Transform(t_rb0)
    rb1pt0.Transform(t_rb1)
    rb1pt1.Transform(t_rb1)

    Dim c As New HingeConstraint(rb0, rb1)
    c.rb0pt0 = rb0pt0
    c.rb0pt1 = rb0pt1
    c.rb1pt0 = rb1pt0
    c.rb1pt1 = rb1pt1

    constraint = c
# ---------- end hinge ----------
ground = VBScript(rb=item.Item)  # -> out, A
# ---------- ground: VB usings ----------
Class GroundConstraint
  Public Const code = "gnd"
  Public rb0 As Object

  Public Sub New(ByRef rb)
    rb0 = rb
  End Sub

End Class
# ---------- ground: VB ----------
    If rb Is Nothing Then Return
   
    A = New GroundConstraint(rb)
    print(A.rb0.guid.ToString())

    Dim ptO As Point3d = A.rb0.plane.Origin()

    Dim vecX As Vector3d = A.rb0.plane.XAxis()
    vecX.Unitize()
    Dim ptX As Point3d = ptO + vecX
    Dim vecY As Vector3d = A.rb0.plane.YAxis()
    vecY.Unitize()
    Dim ptY As Point3d = ptO + vecY

    print(ptO.ToString())
    print(ptX.ToString())
    print(ptY.ToString())
# ---------- end ground ----------

panel_2 = Panel(filter)
file = ReadFile(File=panel_2, PerLineParse=True)
lng = ListLength(List=file)
steps = Panel(lng)
subtraction = Subtraction(A=lng, B=1)
multiplication = Multiplication(A=Slider(1, range=0..1), B=lng)
min = Minimum(A=multiplication, B=subtraction)
item_2 = ListItem(List=file, Index=min, Wrap=True)
txt = Text(item_2)

# ---- group: Fast Responsive Setting
panel_3 = Panel(filter)
settings = VBScript(
    progressiveEnergyThreshold="1e-2",
    finalEnergyThreshold="1e-5",
    progresiveSteps="5",
    finalSteps="100",
    verbose="0",
    logFile=panel_3)  # -> out, setting
# ---------- settings: VB usings ----------
Class OptimizationSetting
  Public progressiveEnergyThreshold As Double
  Public finalEnergyThreshold As Double
  Public progresiveSteps As Integer
  Public finalSteps As Integer
  Public logFile As String = ""
  Public verbose As Integer
  
End Class
# ---------- settings: VB ----------
    Dim s = New OptimizationSetting()
    s.progressiveEnergyThreshold = progressiveEnergyThreshold
    s.finalEnergyThreshold = finalEnergyThreshold
    s.progresiveSteps = progresiveSteps
    s.finalSteps = finalSteps
    s.logFile = logFile
    s.verbose = verbose
    
    setting = s
# ---------- end settings ----------

# ----
merge = Merge(Data1=flatten(rigid_body.rb))
merge_2 = Merge(Data1=flatten(ground.A), Data2=flatten(hinge.constraint), Data3=flatten(end_effector_plane.constraint))
constraints = Data(merge_2)
rigid_bodies = Data(merge)
ik = VBScript(rbs=rigid_bodies, constraints=flatten(constraints), setting=settings.setting)  # -> out, SimResetString, SimUpdateString; inputs rbs: list, constraints: list
# ---------- ik: VB ----------
    If (rbs.count = 0) Then Return

    Dim rbDict As New Dictionary(Of String, Integer)

    Dim _SimResetString As String = "reset;"
    Dim _SimUpdateString As String = "update;"

    'Encode Rifig Bodies
    print("RigidBodyCount=" + rbs.count().ToString())
    _SimResetString += "RigidBodyCount=" + rbs.count().ToString() + ";"
    Dim index As Integer = 0
    For Each rb As Object In rbs
      Dim code As String = rb.code() + ","
      Dim stateArray As Double() = rb.GetStateArray()
      code += String.Join(",", stateArray)
      print(code)
      _SimResetString += code + ";"
      'Add Rigid Body to Dictionary
      rbDict.Add(rb.guid.ToString(), index)
      index += 1
    Next

    'Encode Simulation Parameters
    _SimResetString += "param_progressiveEnergyThreshold=" + setting.progressiveEnergyThreshold.ToString() + ";"
    _SimResetString += "param_finalEnergyThreshold=" + setting.finalEnergyThreshold.ToString() + ";"
    _SimResetString += "param_progresiveSteps=" + setting.progresiveSteps.ToString() + ";"
    _SimResetString += "param_finalSteps=" + setting.finalSteps.ToString() + ";"
    _SimResetString += "param_logFile=" + setting.logFile.ToString() + ";"
    _SimResetString += "param_verbose=" + setting.verbose.ToString() + ";"

    ' Encode Constraints
    Dim constraintID As Integer = 0
    For Each c As Object In constraints
      Dim code As String = c.code()
      Dim codeLine As String

      If code = "gnd" Then
        'Ground Constraint Output
        codeLine = code + "," + rbDict.Item(c.rb0.guid.ToString()).ToString()
        codeLine += "," + constraintID.ToString()
      Else If  code = "hin" Then
        'Hinge Constraint Output
        codeLine = code + "," + FindRBID(c.rb0, rbDict) + "," + FindRBID(c.rb1, rbDict)
        codeLine += "," + PointToString(c.rb0pt0)
        codeLine += "," + PointToString(c.rb0pt1)
        codeLine += "," + PointToString(c.rb1pt0)
        codeLine += "," + PointToString(c.rb1pt1)
        codeLine += "," + constraintID.ToString()
      Else If  code = "ptOnLine" Then
        'Hinge Constraint Output
        codeLine = code + "," + FindRBID(c.rb0, rbDict) + "," + FindRBID(c.rb1, rbDict)
        codeLine += "," + PointToString(c.rb0pt0)
        codeLine += "," + PointToString(c.rb0pt1)
        codeLine += "," + PointToString(c.rb1pt0)
        codeLine += "," + constraintID.ToString()
      Else If  code = "target" Then
        codeLine = code + "," + FindRBID(c.rb0, rbDict)
        codeLine += "," + PointToString(c.rb0pt0)
        codeLine += "," + PointToString(c.rb0pt1)
        codeLine += "," + PointToString(c.rb0pt2)
        codeLine += "," + PointToString(c.tgtpt0)
        codeLine += "," + PointToString(c.tgtpt1)
        codeLine += "," + PointToString(c.tgtpt2)
        codeLine += "," + c.ProgressiveAlpha.ToString()
        codeLine += "," + c.numConstraintPoints.ToString()
        codeLine += "," + constraintID.ToString()
      Else
        'Not a known constraint
        Continue For
      End If


      print(codeLine)
      _SimResetString += codeLine + ";"
      _SimUpdateString += codeLine + ";"

      constraintID += 1
    Next

    SimResetString = _SimResetString
    SimUpdateString = _SimUpdateString
# ---------- ik: VB additional code ----------
  Function FindRBID(rb, rbDict) As String
    'Print(rb.guid.ToString())
    Return rbDict.Item(rb.guid.ToString()).ToString()
  End Function

  Function PointToString(pt As Point3d) As String
    'Return pt.X.ToString("0.#######") + "," + pt.Y.ToString("0.#######") + "," + pt.Z.ToString("0.#######")
    Return pt.X.ToString("e") + "," + pt.Y.ToString("e") + "," + pt.Z.ToString("e")
  End Function
# ---------- end ik ----------

# ---- group: Precise Converge Setting
settings_2 = VBScript(progressiveEnergyThreshold="1e-2", finalEnergyThreshold="1e-9", progresiveSteps="20", finalSteps="10000", verbose="0")  # -> out, setting; same code as settings

# ----
split = TextSplit(Text=txt, Separators=",")
rep = ReplaceText(Text=split, Find=" ", RecursiveReplace=False)
state_to_planes = StateToPlanes(num=rep)
visualiuze_rb = VBScript(plane=flatten(state_to_planes), rb=rigid_bodies)  # -> out, A; inputs plane: Plane; same code as visualiuze_rb
preview_2 = CustomPreview(Geometry=visualiuze_rb.A, Material=ColourSwatch(SwatchColor=RGBA(74, 178, 50, 88)))

reset_simulation = Button()
websocket_client_start = WebsocketClientStart(Address="ws://localhost:9002", InitalMessage=ik.SimResetString, Reset=reset_simulation)
websocket_client_receiver = WebsocketClientReceiver(WebsocketObjects=websocket_client_start, AutoUpdate=True)  # -> Message, Status
websocket_client_sender = WebsocketClientSender(WebsocketObjects=websocket_client_start, Message=ik.SimUpdateString)

cluster = Cluster(T=websocket_client_receiver.Message, rb=rigid_bodies)
preview_3 = CustomPreview(Geometry=cluster, Material=ColourSwatch(SwatchColor=RGB(178, 123, 50)))

# ==== cluster StateToPlanes
num = ClusterInput()
num_2 = Number(num)
graft = GraftTree(Tree=num_2, IncludeEmptyLists=True, IncludeNullItems=True)  # -> simplify(Tree)
path_mapper = PathMapper(graft, source="{A}", target="{floor(A/6)}(A%6)")
item = ListItem(List=path_mapper, Index=0, Wrap=False)  # -> Item, Item1, Item2, Item3, Item4, Item5
pt = ConstructPoint(XCoordinate=item.Item, YCoordinate=item.Item1, ZCoordinate=item.Item2)
xy = XYPlane(Origin=pt)
rx = Number(item.Item3)
ry = Number(item.Item4)
rz = Number(item.Item5)
pln = Plane(xy)
deplane = DeconstructPlane(Plane=pln)  # -> Origin, XAxis, YAxis, ZAxis
rot3d = Rotate3D(Geometry=pln, Angle=rx, Center=deplane.Origin, Axis=deplane.XAxis)  # -> Geometry, Transform
pln_2 = Plane(rot3d.Geometry)
deplane_2 = DeconstructPlane(Plane=pln_2)  # -> Origin, XAxis, YAxis, ZAxis
rot3d_2 = Rotate3D(Geometry=pln_2, Angle=ry, Center=deplane_2.Origin, Axis=deplane_2.YAxis)  # -> Geometry, Transform
pln_3 = Plane(rot3d_2.Geometry)
deplane_3 = DeconstructPlane(Plane=pln_3)  # -> Origin, XAxis, YAxis, ZAxis
rot3d_3 = Rotate3D(Geometry=pln_3, Angle=rz, Center=deplane_3.Origin, Axis=deplane_3.ZAxis)  # -> Geometry, Transform
G = ClusterOutput(rot3d_3.Geometry)

# ==== cluster Cluster
T = ClusterInput()
split = TextSplit(Text=T, Separators=",")
rep = ReplaceText(Text=split, Find=" ", RecursiveReplace=False)
state_to_planes = StateToPlanes(num=rep)
rb = ClusterInput()
visualiuze_rb = VBScript(plane=flatten(state_to_planes), rb=rb)  # -> out, A; inputs plane: Plane
# ---------- visualiuze_rb: VB ----------
    Dim t As Transform = Rhino.Geometry.Transform.ChangeBasis(plane, Rhino.Geometry.Plane.WorldXY)
    Dim _mesh As Rhino.Geometry.Mesh = rb.mesh.Duplicate()
    _mesh.Transform(t)
    A = _mesh
# ---------- end visualiuze_rb ----------
A = ClusterOutput(visualiuze_rb.A)
