# Grasshopper definition SimPackager_V3_SixDofArmOnRail.gh (Grasshopper 1.0.7)
# plug-ins: Firefly.X

geo = Geometry([<brep referenced from the Rhino model> x7])
geo_2 = Geometry(geo)
geo_3 = Geometry(<brep referenced from the Rhino model>)
volume = Volume(Geometry=geo_3)  # -> Volume, Centroid
volume_2 = Volume(Geometry=geo_2)  # -> Volume, Centroid
md_slider = MDSlider(
    SliderMode=0,
    slider_value=Point(0.4592701982, 0.5279392149, 0.5),
    x_domain=Domain(0, 1),
    y_domain=Domain(0, 1),
    z_domain=Domain(0, 1))

timer = Timer(TimerInterval=3000, Target=counter)  # disabled
counter = Counter(CountDirection=True, Step=1, StartStop=Toggle(True), Reset=Toggle(False), OptionalCounterDomain=Domain(0, 100))

xy = XYPlane(Origin=volume.Centroid)
xy_2 = XYPlane(Origin=volume_2.Centroid)
panel = Panel(counter)
rigid_body = VBScript(mesh=geo_3, id=geo_3, plane=xy)  # -> out, rb; inputs mesh: Mesh, id: Guid, plane: Plane
# ---------- rigid_body: VB usings ----------
Public Class RigidBody
  Public const code = "rb"
  Public guid As GUID
  Public mesh As Mesh
  Public plane As Plane

  Public Sub New(ByRef _mesh As Mesh, ByRef _plane As Plane)

    plane = _plane
    Dim t_rb0 As Transform = Rhino.Geometry.Transform.ChangeBasis(Rhino.Geometry.Plane.WorldXY, _plane)
    _mesh.Transform(t_rb0)
    mesh = _mesh
  End Sub

  Public Function Quaternion() As Quaternion
    Return Quaternion.Rotation(Rhino.Geometry.Plane.WorldXY, plane)
  End Function

  ''' <summary>
  ''' Returns the state of the rigid body in an array. XYZABCD
  ''' </summary>
  ''' <returns></returns>
  Public Function GetStateArray() As Double()
    Dim q As Quaternion = Quaternion()
    Dim p As Point3D = plane.origin
    Dim stateArray As Double() = New Double() {p.X, p.Y, p.Z, q.A, q.B, q.C, q.D}
    Return stateArray
  End Function



End Class
# ---------- rigid_body: VB ----------
    If mesh Is Nothing Then Return

    rb = New RigidBody(mesh, plane)
    rb.guid = id

    Print(rb.guid.ToString())

    Dim stateArray As Double() = rb.GetStateArray()
    Print(String.Join(",", stateArray))
# ---------- end rigid_body ----------
rigid_body_2 = VBScript(mesh=geo_2, id=geo_2, plane=xy_2)  # -> out, rb; inputs mesh: Mesh, id: Guid, plane: Plane; same code as rigid_body
panel_2 = Panel("C:\Users\Victor\Documents\GitHub\comp-fab-a2-yck011522\RhinoPython\log.txt")
vb = VBScript(x=panel)  # -> A
# ---------- vb: C# ----------
A = x.ToString("D3")
# ---------- end vb ----------
division = Division(A=panel, B=100)
number_slider = Slider(0, range=0..1)
dam = DataDam(DataA=vb, BufferDelay=20000000, BufferMode=2)
concat = Concatenate(FragmentA="Anim_1_", FragmentB=dam)
panel_3 = Panel(concat)
panel_4 = Panel(panel_3)
srf = Surface(<surface referenced from the Rhino model>)
pt = Point(<point referenced from the Rhino model>)
pt_2 = Point([<point referenced from the Rhino model> x2])
crv = Curve(<curve referenced from the Rhino model>)
eval = EvaluateCurve(Curve=reparameterize(crv), Parameter=division)  # -> Point, Tangent, Angle
concat_2 = Concatenate()
currentviewcapture = CurrentViewCapture(
    PathToFile="D:\test",
    FileName=panel_4,
    Extension="jpg",
    Width=Slider(2000, range=100..2600),
    Height=Slider(1500, range=100..2600),
    DrawGrid=Toggle(False),
    DrawWorldAxes=Toggle(False),
    DrawCPlaneAxes=Toggle(False),
    Activate=Toggle(False))  # -> out, A
# ---------- currentviewcapture: VB ----------
    ' Script created by Eduard Haiman haiman-ed@yandex.ru
    ' Write to PathToFile like C:\Users , without final "\"
    ' Extension can be bmp, tga, jpg, pcx, png or tif
    ' Don't forget to set Activate to  "False"  before close the GH file

    If PathToFile = ""
      print("Path " & PathToFile & " does not exist!")
      Return
    'Else
      'If Dir(PathToFile & "\") <> "" Then
      'Else
      '  print("Path """ & PathToFile & "\" & """ does not exist!")
      '  Return
      'End If
    End If

    Dim DrawGridVB As String = "No"
    Dim DrawWorldAxesVB As String = "No"
    Dim DrawCPlaneAxesVB As String = "No"
    Dim FullName As String = PathToFile & "\" & FileName & "." & Extension


    If DrawGrid Then
      DrawGridVB = "Yes"
    Else
      DrawGridVB = "No"
    End If

    If DrawWorldAxes Then
      DrawWorldAxesVB = "Yes"
    Else
      DrawWorldAxesVB = "No"
    End If

    If DrawCPlaneAxes Then
      DrawCPlaneAxesVB = "Yes"
    Else
      DrawCPlaneAxesVB = "No"
    End If

    print("FullName " & FullName)
    print("Width=" & Width & " Height=" & Height)
    print("DrawGrid=" & DrawGridVB & " DrawWorldAxes=" & DrawWorldAxesVB & " DrawCPlaneAxes=" & DrawCPlaneAxesVB)

    If Activate Then
      app.RunScript("-viewcapturetofile """ & FullName & """ Width=" & Width & " Height=" & Height & " DrawGrid=" & DrawGridVB & " DrawWorldAxes=" & DrawWorldAxesVB & " DrawCPlaneAxes=" & DrawCPlaneAxesVB & " _Enter")
      print("Active...")

      If Dir(FullName) <> "" Then
        print(FileName & "." & Extension & " was CREATED!")
      Else
        print(FileName & "." & Extension & " was NOT created!")
      End If


    Else print("Inactive...")
    End If
# ---------- end currentviewcapture ----------
end_effector_plane = VBScript(
    rb=rigid_body.rb,
    endEffectorPlane=pt_2,
    targetPlane=pt_2,
    ProgressiveAlpha=Slider(20, range=0..100),
    ConstraintType=Slider(1, range=1..3))  # -> out, constraint; inputs endEffectorPlane: Plane, targetPlane: Plane
# ---------- end_effector_plane: VB usings ----------
Class EndEffectorConstraintPt
  Public Const code = "target"
  Public rb0 As Object
  Public rb0pt0 As Point3d
  Public rb0pt1 As Point3d
  Public rb0pt2 As Point3d
  Public tgtpt0, tgtpt1, tgtpt2 As Point3d
  Public ProgressiveAlpha As Double
  Public numConstraintPoints As Integer

  Public Sub New(ByRef _rb0)
    rb0 = _rb0
  End Sub

End Class
# ---------- end_effector_plane: VB ----------
    If rb Is Nothing Then Return
    
    'Create the constraint object
    Dim c As New EndEffectorConstraintPt(rb)

    'Create Transformation to relocate the EndEffector Point to Local Coordinates
    Dim t_rb0 As Transform = Rhino.Geometry.Transform.ChangeBasis(Rhino.Geometry.Plane.WorldXY, rb.plane)

    Dim rb0pt0 As Point3d = New Point3d(endEffectorPlane.Origin())
    Dim rb0pt1 As Point3d = New Point3d(endEffectorPlane.Origin() + endEffectorPlane.XAxis())
    Dim rb0pt2 As Point3d = New Point3d(endEffectorPlane.Origin() + endEffectorPlane.YAxis())


    rb0pt0.Transform(t_rb0)
    rb0pt1.Transform(t_rb0)
    rb0pt2.Transform(t_rb0)

    c.rb0pt0 = rb0pt0
    c.rb0pt1 = rb0pt1
    c.rb0pt2 = rb0pt2

    'Record the world points

    c.tgtpt0 = New Point3d(targetPlane.Origin)
    c.tgtpt1 = New Point3d(targetPlane.Origin + targetPlane.XAxis)
    c.tgtpt2 = New Point3d(targetPlane.Origin + targetPlane.YAxis)

    'Record other values
    c.ProgressiveAlpha = ProgressiveAlpha
    c.numConstraintPoints = ConstraintType


    constraint = c
# ---------- end end_effector_plane ----------
xy_3 = XYPlane(Origin=pt)
filter = StreamFilter(Gate=Toggle(False), Stream1=panel_2)

crv_2 = Curve([<curve referenced from the Rhino model> x6])
shift = ShiftList(List=rigid_body_2.rb, Shift=1, Wrap=False)
shift_2 = ShiftList(List=rigid_body_2.rb, Shift=-1, Wrap=False)
item = ListItem(List=rigid_body_2.rb, Index=0, Wrap=True)  # -> Item, Item1, Item2, Item3, Item4, Item5, Item6
hinge = VBScript(rb0=shift_2, rb1=shift, axis=crv_2)  # -> out, constraint; inputs axis: Line
# ---------- hinge: VB usings ----------
Class HingeConstraint
  Public Const code = "hin"
  Public rb0 As Object
  Public rb1 As Object
  Public rb0pt0 As Point3d
  Public rb0pt1 As Point3d
  Public rb1pt0 As Point3d
  Public rb1pt1 As Point3d

  Public Sub New(ByRef _rb0, ByRef _rb1)
    rb0 = _rb0
    rb1 = _rb1
  End Sub

End Class
# ---------- hinge: VB ----------
    If rb0 Is Nothing Then Return
    If rb1 Is Nothing Then Return
    
    Dim t_rb0 As Transform = Rhino.Geometry.Transform.ChangeBasis(Rhino.Geometry.Plane.WorldXY, rb0.plane)
    Dim t_rb1 As Transform = Rhino.Geometry.Transform.ChangeBasis(Rhino.Geometry.Plane.WorldXY, rb1.plane)
    Dim rb0pt0 As Point3d = New Point3d(axis.From())
    Dim rb0pt1 As Point3d = New Point3d(axis.To())
    Dim rb1pt0 As Point3d = New Point3d(axis.From())
    Dim rb1pt1 As Point3d = New Point3d(axis.To())
    rb0pt0.Transform(t_rb0)
    rb0pt1.Transform(t_rb0)
    rb1pt0.Transform(t_rb1)
    rb1pt1.Transform(t_rb1)

    Dim c As New HingeConstraint(rb0, rb1)
    c.rb0pt0 = rb0pt0
    c.rb0pt1 = rb0pt1
    c.rb1pt0 = rb1pt0
    c.rb1pt1 = rb1pt1

    constraint = c
# ---------- end hinge ----------

srf_cp = SurfaceClosestPoint(Point=eval.Point, Surface=reparameterize(srf))  # -> Point, UVPoint, Distance
evalsrf = EvaluateSurface(Surface=reparameterize(srf), Point=srf_cp.UVPoint)  # -> Point, Normal, UDirection, VDirection, Frame
pt_3 = Point(<point referenced from the Rhino model>)
pt_4 = Point(<point referenced from the Rhino model>)
pt_5 = Point(<point referenced from the Rhino model>)
panel_5 = Panel(currentviewcapture.out)
crv_3 = Curve(<curve referenced from the Rhino model>)
crv_4 = Curve(<curve referenced from the Rhino model>)
pointonline = VBScript(rb0=rigid_body.rb, rb1=item.Item, line=crv_3, point=[pt_3, pt_5])  # -> out, constraint; inputs line: Line, point: Point3d
# ---------- pointonline: VB usings ----------
Class PointOnLineConstraint
  Public Const code = "ptOnLine"
  Public rb0 As Object
  Public rb1 As Object
  Public rb0pt0 As Point3d
  Public rb0pt1 As Point3d
  Public rb1pt0 As Point3d

  Public Sub New(ByRef _rb0, ByRef _rb1)
    rb0 = _rb0
    rb1 = _rb1
  End Sub

End Class
# ---------- pointonline: VB ----------
    If rb0 Is Nothing Then Return
    If rb1 Is Nothing Then Return

    Dim t_rb0 As Transform = Rhino.Geometry.Transform.ChangeBasis(Rhino.Geometry.Plane.WorldXY, rb0.plane)
    Dim t_rb1 As Transform = Rhino.Geometry.Transform.ChangeBasis(Rhino.Geometry.Plane.WorldXY, rb1.plane)
    Dim rb0pt0 As Point3d = New Point3d(line.From())
    Dim rb0pt1 As Point3d = New Point3d(line.To())
    Dim rb1pt0 As Point3d = New Point3d(point)
    rb0pt0.Transform(t_rb0)
    rb0pt1.Transform(t_rb0)
    rb1pt0.Transform(t_rb1)

    Dim c As New PointOnLineConstraint(rb0, rb1)
    c.rb0pt0 = rb0pt0
    c.rb0pt1 = rb0pt1
    c.rb1pt0 = rb1pt0

    constraint = c
# ---------- end pointonline ----------
pointonline_2 = VBScript(rb0=rigid_body.rb, rb1=item.Item, line=crv_4, point=pt_4)  # -> out, constraint; inputs line: Line, point: Point3d
# ---------- pointonline_2: VB ----------
    If rb0 Is Nothing Then Return
    If rb1 Is Nothing Then Return
    
    Dim t_rb0 As Transform = Rhino.Geometry.Transform.ChangeBasis(Rhino.Geometry.Plane.WorldXY, rb0.plane)
    Dim t_rb1 As Transform = Rhino.Geometry.Transform.ChangeBasis(Rhino.Geometry.Plane.WorldXY, rb1.plane)
    Dim rb0pt0 As Point3d = New Point3d(line.From())
    Dim rb0pt1 As Point3d = New Point3d(line.To())
    Dim rb1pt0 As Point3d = New Point3d(point)
    rb0pt0.Transform(t_rb0)
    rb0pt1.Transform(t_rb0)
    rb1pt0.Transform(t_rb1)

    Dim c As New PointOnLineConstraint(rb0, rb1)
    c.rb0pt0 = rb0pt0
    c.rb0pt1 = rb0pt1
    c.rb1pt0 = rb1pt0

    constraint = c
# ---------- end pointonline_2 ----------
end_effector_plane_2 = VBScript(
    rb=item.Item6,
    endEffectorPlane=xy_3,
    targetPlane=evalsrf.Frame,
    ProgressiveAlpha=Slider(20, range=0..100),
    ConstraintType=Slider(3, range=1..3))  # -> out, constraint; inputs endEffectorPlane: Plane, targetPlane: Plane; same code as end_effector_plane
ground = VBScript(rb=rigid_body.rb)  # -> out, A
# ---------- ground: VB usings ----------
Class GroundConstraint
  Public Const code = "gnd"
  Public rb0 As Object

  Public Sub New(ByRef rb)
    rb0 = rb
  End Sub

End Class
# ---------- ground: VB ----------
    If rb Is Nothing Then Return
   
    A = New GroundConstraint(rb)
    print(A.rb0.guid.ToString())

    Dim ptO As Point3d = A.rb0.plane.Origin()

    Dim vecX As Vector3d = A.rb0.plane.XAxis()
    vecX.Unitize()
    Dim ptX As Point3d = ptO + vecX
    Dim vecY As Vector3d = A.rb0.plane.YAxis()
    vecY.Unitize()
    Dim ptY As Point3d = ptO + vecY

    print(ptO.ToString())
    print(ptX.ToString())
    print(ptY.ToString())
# ---------- end ground ----------
preview = CustomPreview(Geometry=srf, Material=ColourSwatch(SwatchColor=RGB(199, 183, 163)))
merge = Merge(Data1=flatten(rigid_body.rb), Data2=flatten(rigid_body_2.rb))
merge_2 = Merge(
    Data1=flatten(ground.A),
    Data2=flatten(pointonline.constraint),
    Data3=flatten(hinge.constraint),
    Data4=flatten(end_effector_plane_2.constraint),
    Data5=flatten(pointonline_2.constraint),
    Data6=flatten(end_effector_plane.constraint))

panel_6 = Panel(filter)
file = ReadFile(File=panel_6, PerLineParse=True)
lng = ListLength(List=file)
steps = Panel(lng)
subtraction = Subtraction(A=lng, B=1)
multiplication = Multiplication(A=Slider(1, range=0..1), B=lng)
min = Minimum(A=multiplication, B=subtraction)
item_2 = ListItem(List=file, Index=min, Wrap=True)
txt = Text(item_2)

# ---- group: Fast Responsive Setting
settings = VBScript(progressiveEnergyThreshold="1e-2", finalEnergyThreshold="1e-4", progresiveSteps="5", finalSteps="100", verbose="0")  # -> out, setting
# ---------- settings: VB usings ----------
Class OptimizationSetting
  Public progressiveEnergyThreshold As Double
  Public finalEnergyThreshold As Double
  Public progresiveSteps As Integer
  Public finalSteps As Integer
  Public logFile As String = ""
  Public verbose As Integer
  
End Class
# ---------- settings: VB ----------
    Dim s = New OptimizationSetting()
    s.progressiveEnergyThreshold = progressiveEnergyThreshold
    s.finalEnergyThreshold = finalEnergyThreshold
    s.progresiveSteps = progresiveSteps
    s.finalSteps = finalSteps
    s.logFile = logFile
    s.verbose = verbose
    
    setting = s
# ---------- end settings ----------

# ---- group: Precise Converge Setting
settings_2 = VBScript(progressiveEnergyThreshold="1e-2", finalEnergyThreshold="1e-9", progresiveSteps="20", finalSteps="10000", verbose="1")  # -> out, setting; same code as settings

# ----
constraints = Data(merge_2)
rigid_bodies = Data(merge)
ik = VBScript(rbs=rigid_bodies, constraints=flatten(constraints), setting=settings.setting)  # -> out, SimResetString, SimUpdateString; inputs rbs: list, constraints: list
# ---------- ik: VB ----------
    If (rbs.count = 0) Then Return

    Dim rbDict As New Dictionary(Of String, Integer)

    Dim _SimResetString As String = "reset;"
    Dim _SimUpdateString As String = "update;"

    'Encode Rifig Bodies
    print("RigidBodyCount=" + rbs.count().ToString())
    _SimResetString += "RigidBodyCount=" + rbs.count().ToString() + ";"
    Dim index As Integer = 0
    For Each rb As Object In rbs
      Dim code As String = rb.code() + ","
      Dim stateArray As Double() = rb.GetStateArray()
      code += String.Join(",", stateArray)
      print(code)
      _SimResetString += code + ";"
      'Add Rigid Body to Dictionary
      rbDict.Add(rb.guid.ToString(), index)
      index += 1
    Next

    'Encode Simulation Parameters
    _SimResetString += "param_progressiveEnergyThreshold=" + setting.progressiveEnergyThreshold.ToString() + ";"
    _SimResetString += "param_finalEnergyThreshold=" + setting.finalEnergyThreshold.ToString() + ";"
    _SimResetString += "param_progresiveSteps=" + setting.progresiveSteps.ToString() + ";"
    _SimResetString += "param_finalSteps=" + setting.finalSteps.ToString() + ";"
    _SimResetString += "param_logFile=" + setting.logFile.ToString() + ";"
    _SimResetString += "param_verbose=" + setting.verbose.ToString() + ";"

    ' Encode Constraints
    Dim constraintID As Integer = 0
    For Each c As Object In constraints
      Dim code As String = c.code()
      Dim codeLine As String

      If code = "gnd" Then
        'Ground Constraint Output
        codeLine = code + "," + rbDict.Item(c.rb0.guid.ToString()).ToString()
        codeLine += "," + constraintID.ToString()
      Else If  code = "hin" Then
        'Hinge Constraint Output
        codeLine = code + "," + FindRBID(c.rb0, rbDict) + "," + FindRBID(c.rb1, rbDict)
        codeLine += "," + PointToString(c.rb0pt0)
        codeLine += "," + PointToString(c.rb0pt1)
        codeLine += "," + PointToString(c.rb1pt0)
        codeLine += "," + PointToString(c.rb1pt1)
        codeLine += "," + constraintID.ToString()
      Else If  code = "ptOnLine" Then
        'Hinge Constraint Output
        codeLine = code + "," + FindRBID(c.rb0, rbDict) + "," + FindRBID(c.rb1, rbDict)
        codeLine += "," + PointToString(c.rb0pt0)
        codeLine += "," + PointToString(c.rb0pt1)
        codeLine += "," + PointToString(c.rb1pt0)
        codeLine += "," + constraintID.ToString()
      Else If  code = "target" Then
        codeLine = code + "," + FindRBID(c.rb0, rbDict)
        codeLine += "," + PointToString(c.rb0pt0)
        codeLine += "," + PointToString(c.rb0pt1)
        codeLine += "," + PointToString(c.rb0pt2)
        codeLine += "," + PointToString(c.tgtpt0)
        codeLine += "," + PointToString(c.tgtpt1)
        codeLine += "," + PointToString(c.tgtpt2)
        codeLine += "," + c.ProgressiveAlpha.ToString()
        codeLine += "," + c.numConstraintPoints.ToString()
        codeLine += "," + constraintID.ToString()
      Else
        'Not a known constraint
        Continue For
      End If


      print(codeLine)
      _SimResetString += codeLine + ";"
      _SimUpdateString += codeLine + ";"

      constraintID += 1
    Next

    SimResetString = _SimResetString
    SimUpdateString = _SimUpdateString
# ---------- ik: VB additional code ----------
  Function FindRBID(rb, rbDict) As String
    'Print(rb.guid.ToString())
    Return rbDict.Item(rb.guid.ToString()).ToString()
  End Function

  Function PointToString(pt As Point3d) As String
    'Return pt.X.ToString("0.#######") + "," + pt.Y.ToString("0.#######") + "," + pt.Z.ToString("0.#######")
    Return pt.X.ToString("e") + "," + pt.Y.ToString("e") + "," + pt.Z.ToString("e")
  End Function
# ---------- end ik ----------
reset_simulation = Button()
websocket_client_start = WebsocketClientStart(Address="ws://localhost:9002", InitalMessage=ik.SimResetString, Reset=reset_simulation)
websocket_client_receiver = WebsocketClientReceiver(WebsocketObjects=websocket_client_start, AutoUpdate=True)  # -> Message, Status
websocket_client_sender = WebsocketClientSender(WebsocketObjects=websocket_client_start, Message=ik.SimUpdateString)
split = TextSplit(Text=txt, Separators=",")
split_2 = TextSplit(Text=websocket_client_receiver.Message, Separators=",")
rep = ReplaceText(Text=split, Find=" ", RecursiveReplace=False)
rep_2 = ReplaceText(Text=split_2, Find=" ", RecursiveReplace=False)
state_to_planes = StateToPlanes(num=rep)
state_to_planes_2 = StateToPlanes(num=rep_2)
visualiuze_rb = VBScript(plane=flatten(state_to_planes), rb=rigid_bodies)  # -> out, A; inputs plane: Plane
# ---------- visualiuze_rb: VB ----------
    Dim t As Transform = Rhino.Geometry.Transform.ChangeBasis(plane, Rhino.Geometry.Plane.WorldXY)
    Dim _mesh As Rhino.Geometry.Mesh = rb.mesh.Duplicate()
    _mesh.Transform(t)
    A = _mesh
# ---------- end visualiuze_rb ----------
visualiuze_rb_2 = VBScript(plane=flatten(state_to_planes_2), rb=rigid_bodies)  # -> out, A; inputs plane: Plane; same code as visualiuze_rb
preview_2 = CustomPreview(Geometry=visualiuze_rb.A, Material=ColourSwatch(SwatchColor=RGBA(178, 50, 50, 88)))
preview_3 = CustomPreview(Geometry=visualiuze_rb_2.A, Material=ColourSwatch(SwatchColor=RGB(178, 123, 50)))

# ==== cluster StateToPlanes
num = ClusterInput()
num_2 = Number(num)
graft = GraftTree(Tree=num_2, IncludeEmptyLists=True, IncludeNullItems=True)  # -> simplify(Tree)
path_mapper = PathMapper(graft, source="{A}", target="{floor(A/6)}(A%6)")
item = ListItem(List=path_mapper, Index=0, Wrap=False)  # -> Item, Item1, Item2, Item3, Item4, Item5
pt = ConstructPoint(XCoordinate=item.Item, YCoordinate=item.Item1, ZCoordinate=item.Item2)
xy = XYPlane(Origin=pt)
rx = Number(item.Item3)
ry = Number(item.Item4)
rz = Number(item.Item5)
pln = Plane(xy)
deplane = DeconstructPlane(Plane=pln)  # -> Origin, XAxis, YAxis, ZAxis
rot3d = Rotate3D(Geometry=pln, Angle=rx, Center=deplane.Origin, Axis=deplane.XAxis)  # -> Geometry, Transform
pln_2 = Plane(rot3d.Geometry)
deplane_2 = DeconstructPlane(Plane=pln_2)  # -> Origin, XAxis, YAxis, ZAxis
rot3d_2 = Rotate3D(Geometry=pln_2, Angle=ry, Center=deplane_2.Origin, Axis=deplane_2.YAxis)  # -> Geometry, Transform
pln_3 = Plane(rot3d_2.Geometry)
deplane_3 = DeconstructPlane(Plane=pln_3)  # -> Origin, XAxis, YAxis, ZAxis
rot3d_3 = Rotate3D(Geometry=pln_3, Angle=rz, Center=deplane_3.Origin, Axis=deplane_3.ZAxis)  # -> Geometry, Transform
G = ClusterOutput(rot3d_3.Geometry)
